vi "Example vi 5.gvi"   [LabVIEW NXG 5.0.0]
panel controls:
  "Text Ring": i32
  "file name": string
  "new extension": string
panel indicators:
  "filename without extension": string
  "unmodified file extension": string
  "lowercase file extension": string
  "file name with new extension": string
uses:
  NI::G Core::File IO (General)::Get File Extension (file name).gvi
  NI::G Core::File IO (General)::Replace File Extension (file name).gvi
diagram:
  call "Get File Extension (file name).gvi"(file name=$"file name") -> (lowercase file extension=w1, unmodified file extension=w2, filename without extension=w3)
  $"lowercase file extension" <- w1
  $"unmodified file extension" <- w2
  $"filename without extension" <- w3
  call "Replace File Extension (file name).gvi"(file name=$"file name", new extension=$"new extension") -> (file name with new extension=w4)
  $"file name with new extension" <- w4
