vi "Naming Cluster Generator.gvi"   [LabVIEW NXG 5.0.0]
inputs:
  "Error In": error
  "Misc Mega Cluster In": "Misc Mega Cluster.gtype"
outputs:
  "Error Out": error
  "Naming Cluster": "Naming Cluster.gtype"
types:
  "Naming Cluster.gtype" = cluster{"Authors Initials": string, "Current Date": string, "Batch Name": string, "Sample Prefix": string}
  "Full Reference Cluster.gtype" = cluster{"Status Report": "Status Report.gtype", "Path Cluster": "Path Cluster.gtype", "Sample Naming Cluster": "Sample Naming Cluster.gtype", "Acquisition Parameters": "Acquisition Parameters.gtype", "Live Progress Cluster": "Live Progress.gtype", "Sample Extra Information": "Sample extra imformation.gtype"}
  "Misc Mega Cluster.gtype" = cluster{"Full Reference Cluster": "Full Reference Cluster.gtype"}
diagram:
  case ($"Error In") {
    frame Error, Default {
      w1 = $"Error In"
      w2 = default
    }
    frame No Error {
      Property Node(instance in=$"Misc Mega Cluster In") -> ("Full Reference Cluster:Sample Naming Cluster:Author Initials"=w3, "Full Reference Cluster:Sample Naming Cluster:Current Date"=w4, "Full Reference Cluster:Sample Naming Cluster:Batch Name"=w5, "Full Reference Cluster:Sample Naming Cluster:Sample Prefix"=w6)
      Property Node(instance in=w3, error in=$"Error In") -> ("Value"=w7, error out=w8)
      Property Node(instance in=w4, error in=w8) -> ("Value"=w9, error out=w10)
      Property Node(instance in=w5, error in=w10) -> ("Value"=w11, error out=w12)
      Property Node(instance in=w6, error in=w12) -> ("Value"=w13, error out=w1)
      Property Node(instance in="Naming Cluster.gtype" {all zero or empty}, "Authors Initials"=w7, "Current Date"=w9, "Batch Name"=w11, "Sample Prefix"=w13) -> (instance out=w2)
    }
  }
  $"Error Out" <- w1
  $"Naming Cluster" <- w2
