vi "Base Path Generation.gvi"   [LabVIEW NXG 5.0.0]
inputs:
  "Error In": error
  "Misc Data Mega Cluster In": "Misc Mega Cluster.gtype"
outputs:
  "Error Out": error
  "Current Batch Folder Path": path
  "Misc Data Mega Cluster Out": "Misc Mega Cluster.gtype"
  "File Naming Cluster": "Naming Cluster.gtype"
types:
  "Naming Cluster.gtype" = cluster{"Authors Initials": string, "Current Date": string, "Batch Name": string, "Sample Prefix": string}
  "Full Reference Cluster.gtype" = cluster{"Status Report": "Status Report.gtype", "Path Cluster": "Path Cluster.gtype", "Sample Naming Cluster": "Sample Naming Cluster.gtype", "Acquisition Parameters": "Acquisition Parameters.gtype", "Live Progress Cluster": "Live Progress.gtype", "Sample Extra Information": "Sample extra imformation.gtype"}
  "Misc Mega Cluster.gtype" = cluster{"Full Reference Cluster": "Full Reference Cluster.gtype"}
uses:
  Pika IV Characterization NXG::Side Functions::Path Manipulation::Check Default Path Subroutine.gvi
  Pika IV Characterization NXG::Main Functions::File Handling::Low Level::Naming Cluster Generator.gvi
  Pika IV Characterization NXG::Side Functions::Path Manipulation::Create or Open Folder.gvi
diagram:
  # This SubVI Generates the folder with the current batc so that every file
  # can be saved within it
  case ($"Error In") {
    frame Error, Default {
      w1 = $"Error In"
      w2 = default
      w3 = $"Misc Data Mega Cluster In"
      w4 = default
    }
    frame No Error {
      call "Check Default Path Subroutine.gvi"(Misc Data Mega Cluster In=$"Misc Data Mega Cluster In", Error In=$"Error In") -> (Misc Data Mega Cluster Out=w3, Default Data Saving Location Path Out=w5, Error Out=w6)
      call "Naming Cluster Generator.gvi"(Misc Mega Cluster=w3, Error In=w6) -> (Naming Cluster=w7, Error Out=w8)
      Property Node(instance in=w7) -> ("Authors Initials"=w9, "Current Date"=w10, "Batch Name"=w11, instance out=w4)
      Concatenate Strings("Device ", w11) -> w12
      call "Create or Open Folder.gvi"(Folder Root Path=w5, Folder Name=w9, Error In=w8) -> (New Folder's Path=w13, Error Out=w14)
      call "Create or Open Folder.gvi"(Folder Root Path=w13, Folder Name=w10, Error In=w14) -> (New Folder's Path=w15, Error Out=w16)
      call "Create or Open Folder.gvi"(Folder Root Path=w15, Folder Name=w12, Error In=w16) -> (New Folder's Path=w2, Error Out=w1)
    }
  }
  $"Misc Data Mega Cluster Out" <- w3
  $"File Naming Cluster" <- w4
  $"Current Batch Folder Path" <- w2
  $"Error Out" <- w1
