vi "Filetype Folder Path Generator.gvi"   [LabVIEW NXG 5.0.0]
inputs:
  "Misc Data Mega Cluster In": "Misc Mega Cluster.gtype"
  "Error In": error
  "Measurement File Type": "Measurement File Type.gtype" = "TXT JV Curve"
outputs:
  "Folder to save data": path
  "Misc Data Mega Cluster Out": "Misc Mega Cluster.gtype"
  "Error Out": error
  "File Name Cluster Out": "Naming Cluster.gtype"
types:
  "Measurement File Type.gtype" = enum{"TXT JV Curve", "TXT Parameters", "Excel", "Origin", "Power Point"}
  "Naming Cluster.gtype" = cluster{"Authors Initials": string, "Current Date": string, "Batch Name": string, "Sample Prefix": string}
  "Full Reference Cluster.gtype" = cluster{"Status Report": "Status Report.gtype", "Path Cluster": "Path Cluster.gtype", "Sample Naming Cluster": "Sample Naming Cluster.gtype", "Acquisition Parameters": "Acquisition Parameters.gtype", "Live Progress Cluster": "Live Progress.gtype", "Sample Extra Information": "Sample extra imformation.gtype"}
  "Misc Mega Cluster.gtype" = cluster{"Full Reference Cluster": "Full Reference Cluster.gtype"}
uses:
  Pika IV Characterization NXG::Main Functions::File Handling::Path Generation::Base Path Generation.gvi
  Pika IV Characterization NXG::Side Functions::Path Manipulation::Create or Open Folder.gvi
diagram:
  # This SubVI Generates the file paths and filenames for the different types of files that will be saved
  case ($"Error In") {
    frame Error, Default {
      w1 = $"Error In"
      w2 = default
      w3 = $"Misc Data Mega Cluster In"
      w4 = default
    }
    frame No Error {
      call "Base Path Generation.gvi"(Misc Data Mega Cluster In=$"Misc Data Mega Cluster In", Error In=$"Error In") -> (Misc Data Mega Cluster Out=w5, Current Batch Folder Path=w6, File Naming Cluster=w4, Error Out=w7)
      case ($"Measurement File Type") {
        frame "TXT JV Curve", Default {
          call "Create or Open Folder.gvi"(Folder Root Path=w6, Folder Name="TXT Files", Error In=w7) -> (New Folder's Path=w2, Error Out=w1)
          w3 = w5
        }
        frame "TXT Parameters" {
          call "Create or Open Folder.gvi"(Folder Root Path=w6, Folder Name="TXT Files", Error In=w7) -> (New Folder's Path=w2, Error Out=w1)
          w3 = w5
        }
        frame "Excel" {
          call "Create or Open Folder.gvi"(Folder Root Path=w6, Folder Name="Excel Files", Error In=w7) -> (New Folder's Path=w2, Error Out=w1)
          w3 = w5
        }
        frame "Origin" {
          call "Create or Open Folder.gvi"(Folder Root Path=w6, Folder Name="OriginLab Files", Error In=w7) -> (New Folder's Path=w2, Error Out=w1)
          w3 = w5
        }
        frame "Power Point" {
          call "Create or Open Folder.gvi"(Folder Root Path=w6, Folder Name="Power Point Files", Error In=w7) -> (New Folder's Path=w2, Error Out=w1)
          w3 = w5
        }
      }
    }
  }
  $"Misc Data Mega Cluster Out" <- w3
  $"File Name Cluster Out" <- w4
  $"Folder to save data" <- w2
  $"Error Out" <- w1
