vi "Full Data File Generator.gvi"   [LabVIEW NXG 5.0.0]
inputs:
  "Error In": error
  "Measurement File Type": "Measurement File Type.gtype" = "TXT JV Curve"
  "Variable Header Info": string
  "Data Array To Save": f64[][]
  "Formatted Data String Array": string[][]
outputs:
  "Error Out": error
  "Full Data Spreadsheet": string
types:
  "Measurement File Type.gtype" = enum{"TXT JV Curve", "TXT Parameters", "Excel", "Origin", "Power Point"}
uses:
  Pika IV Characterization NXG::Main Functions::File Handling::Header Info Merger.gvi
diagram:
  case ($"Error In") {
    frame Error, Default {
      w1 = $"Error In"
      w2 = default
    }
    frame No Error {
      case ($"Measurement File Type") {
        frame "TXT JV Curve", Default {
          Array To Spreadsheet String(array=$"Data Array To Save", format string="%g") -> (spreadsheet string=w4)
          Build Array(["Voltage (V)", "Current (A)", "Current Density (A/m^2)"], $"Variable Header Info") -> w3
        }
        frame "TXT Parameters" {
          w5 = ["Cell Label", "Voc (V)", "Jsc (A/m^2)", "Efficiency (%)", "FF (%)", "Rs (Ω · m^2)", "Rsh (Ω · m^2)", "Light Power Density (W/m^2)"]
          Array To Spreadsheet String(array=$"Formatted Data String Array", format string="%g") -> (spreadsheet string=w4)
          w3 = w5
        }
        frame "Excel" {
          w6 = ["Cell Label", "Voc (V)", "Jsc (A/m^2)", "Efficiency (%)", "FF (%)", "Rs (Ω · m^2)", "Rsh (Ω · m^2)", "Light Power Density (W/m^2)"]
          Array To Spreadsheet String(array=$"Formatted Data String Array", format string="%g") -> (spreadsheet string=w4)
          w3 = w6
        }
        frame "Origin" {
          w3 = default
          w4 = default
        }
        frame "Power Point" {
          w3 = default
          w4 = default
        }
      }
      call "Header Info Merger.gvi"(Column info array=w3, Spreadsheet String=w4, Error In=$"Error In") -> (Spreadsheet String With Header=w2, Error Out=w1)
    }
  }
  $"Full Data Spreadsheet" <- w2
  $"Error Out" <- w1
