vi "Full IV Measurement Subroutine.gvi"   [LabVIEW NXG 5.0.0]
panel controls:
  "Error In": error
  "SRM Mega Cluster In": "SRM Mega Cluster.gtype"
  "Instrument Control Mega Cluster In": "Instrument Control Mega Cluster.gtype"
  "Misc Data Mega Cluster In": "Misc Mega Cluster.gtype"
panel indicators:
  "Error Out": error
  "Misc Data Mega Cluster Out": "Misc Data Mega Cluster.gtype"
  "Instrument Control Mega Cluster Out": "Instrument Control Mega Cluster.gtype"
  "SRM Mega Cluster Out": "SRM Mega Cluster.gtype"
types:
  "SRM Specific Parameters.gtype" = cluster{"Max (V)": f64, "Min (V)": f64, "V Points": u32, "Current Range (A)": f64, "Autorange": bool, "Sweep Dir": bool, "Current Averages": u32, "Max (A)": f64, "Integration Time": f64, "Cell Area (m^2)": f64, "Full Spctr Ref": bool}
  "Raibow Sweep Selector.gtype" = enum{"Red Sweep", "Blue Sweep", "Full Sweep Red First", "Full Sweep Blue First"}
  "Rainbow Sweep Param Selector.gtype" = cluster{"Raibow Sweep Selector": "Raibow Sweep Selector.gtype", "Max Wavelength (nm)": f64, "Min Wavelength (nm)": f64, "Wavelength Step (nm)": f64, "Rainbow Sweep Type Selector": "Rainbow Sweep Type Selector.gtype"}
  "Rainbow Sweep Types.gtype" = enum{"Red Sweep Closing", "Red Sweep Opening", "Blue Sweep Closing", "Blue Sweep Opening"}
  "IV Full Data Cluster.gtype" = cluster{"IV Measurements Array": "IV Single Measurement.gtype"[], "Rainbow Sweep Types": "Rainbow Sweep Types.gtype", "IV Refined Data": "IV Refined Full Sweep Data.gtype", "Total Light Power Density (W/m^2)": f64}
  "IV Full Raw Data.gtype" = cluster{"Rainbow Sweep Types": "Rainbow Sweep Types.gtype", "IV Raw Data Array": "IV Single Measurement.gtype"[]}
  "SRM Mega Cluster.gtype" = cluster{"SRM Specific Parameters": "SRM Specific Parameters.gtype", "Rainbow Sweep Parameters SRM": "Rainbow Sweep Param Selector.gtype", "SRM Full IV data Array": "IV Full Data Cluster.gtype"[], "Full IV Curve Raw Data": "IV Full Raw Data.gtype"[]}
  "Full Reference Cluster.gtype" = cluster{"Enum Reference Cluster": "Enum Control Reference Cluster.gtype", "Boolean Reference Cluster": "Boolean Control Reference Cluster.gtype", "Numeric Reference Cluster": "Numeric Control Reference Cluster.gtype", "Numeric Cluster Reference Cluster": "Numeric Cluster Reference Cluster.gtype", "Path Reference Cluster": "Path Reference Cluster.gtype", "Cluster Reference Cluster": "Cluster Reference Cluster.gtype", "XZ Stage Controls Reference Cluster": "XZ Stage Controls Reference Cluster.gtype"}
  "Cell Naming Cluster.gtype" = cluster{"Cell Label": string, "Sample Prefix": string, "Author Initials": string, "Current Date": string, "Batch Name": string}
  T1 = cluster{"X Coordinate (mm)": f64, "Z Coordinate (mm)": f64, "Aprch Distance (mm)": f64}
  T2 = cluster{"X Coordinate (mm)": f64, "Z Coordinate (mm)": f64, "Vertical Spacing (mm)": f64, "Aprch Distance (mm)": f64, "Aprch Dstnc L.12 (mm)": f64}
  "XZ All Position Cluster.gtype" = cluster{"Diffusor Coordinates": T1, "Photodetector Coordinates": T1, "Cell R.01 Coordinates": T2}
  T3 = cluster{"Thorlabs Motor Serial Number File Path": path, "Default Data Saving Location": path}
  "Misc Data Mega Cluster.gtype" = cluster{"Full Reference Cluster": "Full Reference Cluster.gtype", "Cell Naming Cluster": "Cell Naming Cluster.gtype", "All XZ Position Cluster": "XZ All Position Cluster.gtype", "All Paths": T3}
  "Instrument Coms Info.gtype" = cluster{"Arduino Coms Info": "Arduino Detection cluster control.gtype", "Photodetector Names": string[], "Keythley Address": "VISA Instr", "Photodetector Detected?": bool, "Thorlabs Motors Detected?": bool, "Keithley Detected?": bool, "Thorlabs Motors Serial Number": "Thorlabs Motors Serial Number In.gtype", "Photodetector IVI session": "Ivi IviDefault", "Flame ID": string, "Flame Detected?": bool, "Flame Wrapper ID": u64}
  "Debugging Cluster.gtype" = cluster{"Debugging mode?": bool, "Initialize App": bool, "Insturment Debugging": "Insturment Debugging Cluster.gtype"}
  "Instrument Control Mega Cluster.gtype" = cluster{"Instruments Coms Info": "Instrument Coms Info.gtype", "Debugging Cluster": "Debugging Cluster.gtype"}
  "Misc Mega Cluster.gtype" = cluster{"Full Reference Cluster": "Full Reference Cluster.gtype"}
  "XZ Coordinate Cluster In.gtype" = cluster{"X Coordinate (mm)": f64, "Z Coordinate (mm)": f64}
uses:
  Pika IV Characterization NXG::Main Functions::IV Curves::FGV IV Operation.gvi
  Pika IV Characterization NXG::Main Functions::Instruction Handling::FGV Current State.gvi
  Pika IV Characterization NXG::Side Functions::Abort Control::FGV Global Abort.gvi
  Pika IV Characterization NXG::Side Functions::Instrument Control::Keithley::Keithley Initialization Subroutine.gvi
  Rainbow Measurement Setup::Main Functions::Instruction Queue::Current State::FGV Current State.gvi
  Rainbow Measurement Setup::Side Functions::Instrument Control::Thorlabs Motors::Movement::KCube Move to 0 or Home.gvi
  Rainbow Measurement Setup::Side Functions::Instrument Control::Arduino::XZ Stage Arduino::XZ Stage Initialize And Home.gvi
  Rainbow Measurement Setup::Side Functions::Provisional Cell Selection FGV.gvi
  Rainbow Measurement Setup::Side Functions::Instrument Control::Arduino::XZ Stage Arduino::XZ Stage Label to Coordinates.gvi
  Rainbow Measurement Setup::Side Functions::Instrument Control::Arduino::XZ Stage Arduino::XZ Stage Move to Position.gvi
  Rainbow Measurement Setup::Side Functions::Instrument Control::Keithley::Keithley Initialize Subroutine.gvi
  Rainbow Measurement Setup::Main Functions::Rainbow Measurement::Cell Single Rainbow Measurement::SRM Rainbow Sweep.gvi
  Rainbow Measurement Setup::Side Functions::Instrument Control::Thorlabs Motors::Movement::KCube Motors Close.gvi
  Rainbow Measurement Setup::Side Functions::Instrument Control::Arduino::XZ Stage Arduino::XZ Stage Close Coms.gvi
  Rainbow Measurement Setup::Side Functions::Instrument Control::Keithley::Keithley Close Subroutine.gvi
  Rainbow Measurement Setup::Main Functions::Rainbow Measurement::Cell Single Rainbow Measurement::IV Calculations::SRM IV Parameters Calculator.gvi
  Rainbow Measurement Setup::Main Functions::Rainbow Measurement::Cell Single Rainbow Measurement::SRM Live Parameters::SRM Sweep Live Parameters FGV.gvi
  Rainbow Measurement Setup::Main Functions::Rainbow Measurement::Cell Single Rainbow Measurement::Plotting::SRM Sweep Refined Data FGV.gvi
  Rainbow Measurement Setup::Main Functions::Rainbow Measurement::Cell Single Rainbow Measurement::File Handling::SRM Save Graphs Prompt.gvi
  Rainbow Measurement Setup::Main Functions::Rainbow Measurement::Cell Single Rainbow Measurement::File Handling::SRM file handling.gvi
  Rainbow Measurement Setup::Main Functions::Rainbow Measurement::Cell Single Rainbow Measurement::File Handling::SRM Load Prompt.gvi
  Rainbow Measurement Setup::Side Functions::Messages And Prompts::General Simple Prompt.gvi
  Rainbow Measurement Setup::Main Functions::Rainbow Measurement::Cell Single Rainbow Measurement::LPC Check::New Light Calibration Enqueue.gvi
  Rainbow Measurement Setup::Main Functions::Rainbow Measurement::Single Multiple Measurement Utilities::FGV Last Measurement Type.gvi
  Pika IV Characterization NXG::Side Functions::Timeout::FGV Progress.gvi
diagram:
  # This SubVI Measures the Light power for each motor position for each sweep type and outputs the data so that it can be plotted
  # on the main window for checking and for calibration purposes
  case ($"Error In") {
    frame Error, Default {
      w1 = $"Error In"
      w2 = $"Instrument Control Mega Cluster In"
      w3 = $"SRM Mega Cluster In"
      w4 = $"Misc Data Mega Cluster In"
    }
    frame No Error {
      call "FGV IV Operation.gvi"(FGV Instructions="Read State", Error In=$"Error In") -> (IV Operation Out=w5, Error Out=w6)
      case (w5) {
        frame "Load Measurement" {
          Property Node(instance in=$"SRM Mega Cluster In", "SRM Full IV data Array"="IV Full Data Cluster.gtype"[] [], "Full IV Curve Raw Data"="IV Full Raw Data.gtype"[] []) -> (instance out=w7)
        }
        frame "Save Measurement" {
          w7 = $"SRM Mega Cluster In"
        }
        frame "Aquire Measurement", Default {
          Property Node(instance in=$"SRM Mega Cluster In", "SRM Full IV data Array"="IV Full Data Cluster.gtype"[] [], "Full IV Curve Raw Data"="IV Full Raw Data.gtype"[] []) -> (instance out=w7)
        }
      }
      call "FGV Current State.gvi"(Current State Instructions="Set Current State and Substate", Current State="IV Curves Acquisition", Current Substate="", Error In=w6) -> (Error Out=w8)
      s1 = w8  # shift register
      s2 = "Start App"  # shift register
      s2.prev1 = uninitialised  # shift register
      s3 = $"Instrument Control Mega Cluster In"  # shift register
      s4 = $"Misc Data Mega Cluster In"  # shift register
      s5 = w7  # shift register
      while {
        call "FGV Global Abort.gvi"(Global Abort Instructions="Read Current State", Error In=s1) -> (Local Abort Out=w9, Global Abort Out=w10, Error Out=w11)
        Is Not Equal(x=s2, y="Stop App") -> w12
        Logical And(w12, w9) -> w13
        Select(s=w13, t="Start App", f=s2) -> w14
        case (w14) {
          frame "Start App", Default {
            call "FGV Current State.gvi"(Current State Instructions="Set Current Substate", Current Substate="Starting IV Measurements", Error In=w11) -> (Error Out=w15)
            w16 = "Initialize Instruments"
            w17 = default
            w18 = s5
            w19 = s3
            w20 = s4
          }
          frame "Initialize Instruments" {
            call "FGV Current State.gvi"(Current State Instructions="Set Current Substate", Current Substate="Initializing Instruments", Error In=w11) -> (Error Out=w21)
            call "Keithley Initialization Subroutine.gvi"(Instrument Control Mega Cluster In=s3, Error In=w21) -> (Instrument Control Mega Cluster Out=w19, Error Out=w15)
            w16 = "Acquire IV Curves"
            w17 = default
            w18 = _
            w20 = _
          }
          frame "Acquire IV Curves" {
            w15 = _
            w16 = w22
            w17 = default
            w18 = _
            w19 = _
            w20 = _
          }
          frame "Close Coms" {
            call "FGV Current State.gvi"(Current State Instructions="Set Current Substate", Current Substate="Initializing Instruments", Error In=w11) -> (Error Out=w23)
            call "KCube Move to 0 or Home.gvi"(Instrument Control Mega Cluster In=s3, Error In=w23) -> (Instrument Control Mega Cluster Out=w24, Error Out=w25)
            call "XZ Stage Initialize And Home.gvi"(Instrument Control Mega Cluster In=w24, Error In=w25) -> (Instrument Control Mega Cluster Out=w26, Error Out=w27)
            call "Provisional Cell Selection FGV.gvi"(FGV Instructions="Read State", Error In=w27) -> (Desired Cell String=w28, Error Out=w29)
            call "XZ Stage Label to Coordinates.gvi"(Cell Label=w28, Misc Data Mega Cluster In=s4, Error In=w29) -> (XZ Coordinate Out=w30, Error Out=w31)
            call "XZ Stage Move to Position.gvi"(Instrument Control Mega Cluster In=w26, Error In=w31, XZ Coordinate Cluster In=w30) -> (Instrument Control Mega Cluster Out=w32, Error Out=w33)
            call "Keithley Initialize Subroutine.gvi"(Instrument Control Mega Cluster In=w32, Error In=w33) -> (Instrument Control Mega Cluster Out=w19, Error Out=w15)
            w16 = w34
            w17 = default
            w18 = s5
            w20 = s4
          }
          frame "Process IV Data" {
            call "FGV Current State.gvi"(Current State Instructions="Set Current Substate", Current Substate="Acquiring Spectra", Error In=w11) -> (Error Out=w35)
            call "SRM Rainbow Sweep.gvi"(Instrument Control Mega Cluster In=s3, SRM Mega Cluster In=s5, LPC Mega Cluster In=_, Error In=w35) -> (Instrument Control Mega Cluster Out=w19, SRM Mega Cluster Out=w18, Error Out=w15)
            w16 = w36
            w17 = default
            w20 = s4
          }
          frame "Load Measurement" {
            Select(s=w9, t="Stop App", f="Process IV Data")
            call "FGV Current State.gvi"(Current State Instructions="Set Current Substate", Current Substate="Closing Coms", Error In=w11) -> (Error Out=w37)
            call "KCube Motors Close.gvi"(Instrument Control Mega Cluster In=s3, Error In=w37) -> (Instrument Control Mega Cluster Out=w38, Error Out=w39)
            call "XZ Stage Move to Position.gvi"(Instrument Control Mega Cluster In=w38, Error In=w39, XZ Coordinate Cluster In="XZ Coordinate Cluster In.gtype" {all zero or empty}) -> (Instrument Control Mega Cluster Out=w40, Error Out=w41)
            call "XZ Stage Close Coms.gvi"(Instrument Control Mega Cluster In=w40, Error In=w41) -> (Instrument Control Mega Cluster Out=w42, Error Out=w43)
            call "Keithley Close Subroutine.gvi"(Instrument Control Mega Cluster In=w42, Error In=w43) -> (Instrument Control Mega Cluster Out=w19, Error Out=w15)
            w16 = _
            w17 = default
            w18 = s5
            w20 = s4
          }
          frame "Save Files" {
            call "SRM IV Parameters Calculator.gvi"(SRM Mega Cluster In=s5, Error In=w11) -> (SRM Mega Cluster Out=w18, SRM sweep live parameters FGV Cluster Out=w44, Error Out=w45)
            call "SRM Sweep Live Parameters FGV.gvi"(FGV Instructions="Read State", SRM sweep live parameters FGV Cluster In=w44, Error In=w45) -> (Error Out=w46)
            call "SRM Sweep Refined Data FGV.gvi"(SRM Mega Cluster In=w18, Error In=w46, FGV Instructions="Set State") -> (Error Out=w47)
            call "SRM Save Graphs Prompt.gvi"(Previous State=s2.prev1, Error In=w47) -> (Error Out=w15)
            w16 = _
            w17 = default
            w19 = s3
            w20 = s4
          }
          frame "Stop App" {
            call "FGV Current State.gvi"(Current State Instructions="Set Current Substate", Current Substate="Loading Calibration", Error In=w11) -> (Error Out=w48)
            call "SRM file handling.gvi"(SRM Mega Cluster In=s5, Misc Data Mega Cluster In=s4, Error In=w48, Modify File Operation="Load TXT") -> (SRM Mega Cluster Out=w18, Boolean Handler Out=w49, Loaded Files=w50, Error Out=w51)
            call "SRM Load Prompt.gvi"(Boolean Handler In=w49, Loaded Files=w50, Error In=w51) -> (Error Out=w15)
            w16 = _
            w17 = default
            w19 = s3
            w20 = s4
          }
          frame "8" {
            call "FGV Current State.gvi"(Current State Instructions="Set Current Substate", Current Substate="Saving Graphs", Error In=w11) -> (Error Out=w52)
            call "SRM file handling.gvi"(SRM Mega Cluster In=s5, Misc Data Mega Cluster In=s4, Error In=w52, Modify File Operation="Save TXT") -> (SRM Mega Cluster Out=w18, Error Out=w53)
            w54 = "Your Measurement Files Have been saved\npropperly on your personal data folder."
            call "General Simple Prompt.gvi"(Prompt Message=w54, Okay Button Message="Perfect Thanks :)", Error In=w53, Prompt?=TRUE) -> (Error Out=w15)
            w16 = w55
            w17 = default
            w19 = s3
            w20 = s4
          }
          frame "9" {
            call "New Light Calibration Enqueue.gvi"(Queue In=_, Misc Data Mega Cluster In=s4, Error In=w11) -> (Queue Out=w56, Error Out=w15)
            w16 = w57
            w17 = default
            w18 = s5
            w19 = s3
            w20 = s4
          }
          frame "10" {
            call "FGV Last Measurement Type.gvi"(FGV Instructions="Set State", Last Measurement Type="Rainbow Single Measurement", Error In=w11) -> (Error Out=w58)
            call "FGV Current State.gvi"(Current State Instructions="Set Current Substate", Current Substate="Stopping Apps", Error In=w58) -> (Error Out=w15)
            w16 = _
            w17 = TRUE
            w18 = s5
            w19 = s3
            w20 = s4
          }
        }
        call "FGV Progress.gvi"(FGV Instructions="Set State", Progress In=0, Error In=w15) -> (Error Out=w59)
        Logical Or(w10, w59, w17) -> w60
        next s1 = w59
        next s2 = w16
        next s3 = w19
        next s4 = w20
        next s5 = w18
        stop if w60
      }
      w1 = s1
      w2 = s3
      w3 = s5
      w4 = s4
    }
  }
  $"Instrument Control Mega Cluster Out" <- w2
  $"Misc Data Mega Cluster Out" <- w4
  $"Error Out" <- w1
  $"SRM Mega Cluster Out" <- w3
