vi "IV Curves Acquiring.gvi"   [LabVIEW NXG 5.0.0]
inputs:
  "Instrument Control Mega Cluster In": "Instrument Control Mega Cluster.gtype"
  "IV Measurements Mega Cluster In": "IV Measurements Mega Cluster.gtype"
  "Error In": error
outputs:
  "Instrument Control Mega Cluster Out": "Instrument Control Mega Cluster.gtype"
  "IV Measurements Mega Cluster Out": "IV Measurements Mega Cluster.gtype"
  "Error Out": error
types:
  T1 = cluster{"Element 1": "VISA Instr", "Element 2": string}
  T2 = enum{"Keithley 2400 Series", "Keithley 2450 Series"}
  "Instrument Control.gtype" = cluster{"Multiplexer Arduino Detected?": bool, "Multiplexer Arduino Address": "VISA Instr", "Arduinos List": T1[], "Multiplexer Log": string, "Keythley Address": "VISA Instr", "Keithley Detected?": bool, "Keithley ID": string, "Detected Keithley Type": T2}
  "Debugging Cluster.gtype" = cluster{"Debugging mode?": bool, "Initialize App": bool, "Insturment Debugging": cluster{"Keithley": bool, "Arduino": bool}}
  "Instrument Control Mega Cluster.gtype" = cluster{"Instrument Control": "Instrument Control.gtype", "Debugging Cluster": "Debugging Cluster.gtype"}
  "IV Mode.gtype" = enum{"Rough", "Normal", "Accurate", "Smart", "Custom"}
  "IV Curve Parameters.gtype" = cluster{"Cell Parameters": "Cell Parameters.gtype", "Measurement Precision": "Accuracy Parameters.gtype", "IV Accuracy Mode": "IV Mode.gtype"}
  T3 = cluster{"L.01": bool, "R.01": bool, "L.02": bool, "R.02": bool, "L.03": bool, "R.03": bool, "L.04": bool, "R.04": bool, "L.05": bool, "R.05": bool, "L.06": bool, "R.06": bool, "L.07": bool, "R.07": bool, "L.08": bool, "R.08": bool, "L.09": bool, "R.09": bool, "L.10": bool, "R.10": bool, "L.11": bool, "R.11": bool, "L.12": bool, "R.12": bool}
  "Cell Selector.gtype" = cluster{"All": bool, "Left": bool, "Right": bool, "Cell Cluster": T3, "Reset": bool, "Random Order ": bool, "Continuous Cell": bool}
  "IV Data Cluster.gtype" = cluster{"Voltage (V)": f64[], "Current (A)": f64[], "Current Density (A/m^2)": f64[], "Cell Area (m^2)": f64, "Illumination (W/m^2)": f64, "Voc (V)": f64, "Jsc (A/m^2)": f64, "FF (%)": f64, "Rsh (Ω · m^2)": f64, "Rs (Ω · m^2)": f64, "Eff (%)": f64, "Measured Cell": "Cell Selector.gtype", "Continuous Cell": bool}
  "IV Measurements Mega Cluster.gtype" = cluster{"IV Curve Parameters": "IV Curve Parameters.gtype", "Cell Selector": "Cell Selector.gtype", "Cell Array": "Cell Selector.gtype"[], "IV Full Data Array": "IV Data Cluster.gtype"[]}
uses:
  Pika IV Characterization NXG::Side Functions::Messages And Prompts::FGV Cancel Prompts until Finished Routine.gvi
  Pika IV Characterization NXG::Side Functions::Instrument Control::Keithley::Keithley Set Constant Parameters.gvi
  Pika IV Characterization NXG::Main Functions::IV Curves::Measurements::Extract Cell Array.gvi
  Pika IV Characterization NXG::Side Functions::Abort Control::FGV Global Abort.gvi
  Pika IV Characterization NXG::Side Functions::Instrument Control::Keithley::Keithley Sweep Subroutine.gvi
  Pika IV Characterization NXG::Main Functions::IV Curves::Calculations::IV Full Processing.gvi
  Pika IV Characterization NXG::Side Functions::Timeout::Progress General Calculator.gvi
  Pika IV Characterization NXG::Side Functions::Timeout::FGV Progress.gvi
diagram:
  # This SubVI Takes the specified Parameters both for the sweep types and for the keithley electrical sweep and performs all the measurements while storing them on their
  # corresponding clusters, before outputing all the information within the Full IV Curve Data array.
  case ($"Error In") {
    frame Error, Default {
      w1 = $"Error In"
      w2 = $"Instrument Control Mega Cluster In"
      w3 = $"IV Measurements Mega Cluster In"
    }
    frame No Error {
      call "FGV Cancel Prompts until Finished Routine.gvi"(Error In=$"Error In", FGV Instructions="Reset State") -> (Error Out=w4)
      call "Keithley Set Constant Parameters.gvi"(Instrument Control Mega Cluster In=$"Instrument Control Mega Cluster In", IV Measurements Mega Cluster In=$"IV Measurements Mega Cluster In", Error In=w4) -> (Instrument Control Mega Cluster Out=w5, IV Measurements Mega Cluster Out=w6, Error Out=w7)
      call "Extract Cell Array.gvi"(IV Measurements Mega Cluster In=w6, Error In=w7) -> (IV Measurements Mega Cluster Out=w8, Cell Array=w9, Error Out=w10)
      s1 = w10  # shift register
      s2 = w5  # shift register
      s3 = w8  # shift register
      for (iteration -> i1) {
        w11 = each element of w9
        call "FGV Global Abort.gvi"(Global Abort Instructions="Read Current State", Error In=s1) -> (Local Abort Out=w12, Global Abort Out=w13, Error Out=w14)
        call "Keithley Sweep Subroutine.gvi"(Instrument Control Mega Cluster In=s2, IV Measurements Mega Cluster In=s3, Error In=w14) -> (Instrument Control Mega Cluster Out=w15, IV Measurements Mega Cluster Out=w16, IV Data Cluster Out=w17, Error Out=w18)
        call "IV Full Processing.gvi"(IV Measurements Mega Cluster In=w16, IV Data Cluster In=w17, Current Cell=w11, Error In=w18) -> (IV Measurements Mega Cluster Out=w19, Error Out=w20)
        call "Progress General Calculator.gvi"(Starting Value=40, Ending Value=80, Current Step=i1, Error In=w20) -> (Current Progress=w21, Error Out=w22)
        call "FGV Progress.gvi"(FGV Instructions="Set State", Progress In=w21, Error In=w22) -> (Error Out=w23)
        Logical Or(w12, w13) -> w24
        Wait Until Next Multiple(multiple to wait=10)
        next s1 = w23
        next s2 = w15
        next s3 = w19
        stop if w24
      }
      w1 = s1
      w2 = s2
      w3 = s3
    }
  }
  $"Instrument Control Mega Cluster Out" <- w2
  $"IV Measurements Mega Cluster Out" <- w3
  $"Error Out" <- w1
