vi "Initialize App Subroutine.gvi"   [LabVIEW NXG 5.0.0]
inputs:
  "Error In": error
  "Instrument Control Mega Cluster In": "Instrument Control Mega Cluster.gtype"
  "Misc Data Mega Cluster In": "Misc Mega Cluster.gtype"
outputs:
  "Error Out": error
  "Instrument Control Mega Cluster Out": "Instrument Control Mega Cluster.gtype"
  "Misc Data Mega Cluster Out": "Misc Mega Cluster.gtype"
types:
  "Full Reference Cluster.gtype" = cluster{"Status Report": "Status Report.gtype", "Path Cluster": "Path Cluster.gtype", "Sample Naming Cluster": "Sample Naming Cluster.gtype", "Acquisition Parameters": "Acquisition Parameters.gtype", "Live Progress Cluster": "Live Progress.gtype", "Sample Extra Information": "Sample extra imformation.gtype"}
  "Misc Mega Cluster.gtype" = cluster{"Full Reference Cluster": "Full Reference Cluster.gtype"}
  T1 = cluster{"Element 1": "VISA Instr", "Element 2": string}
  T2 = enum{"Keithley 2400 Series", "Keithley 2450 Series"}
  "Instrument Control.gtype" = cluster{"Multiplexer Arduino Detected?": bool, "Multiplexer Arduino Address": "VISA Instr", "Arduinos List": T1[], "Multiplexer Log": string, "Keythley Address": "VISA Instr", "Keithley Detected?": bool, "Keithley ID": string, "Detected Keithley Type": T2}
  "Debugging Cluster.gtype" = cluster{"Debugging mode?": bool, "Initialize App": bool, "Insturment Debugging": cluster{"Keithley": bool, "Arduino": bool}}
  "Instrument Control Mega Cluster.gtype" = cluster{"Instrument Control": "Instrument Control.gtype", "Debugging Cluster": "Debugging Cluster.gtype"}
uses:
  Pika IV Characterization NXG::Main Functions::Instruction Handling::FGV Current State.gvi
  Pika IV Characterization NXG::Main Functions::Initializing App::Initialize App Instruction Extractor.gvi
  Pika IV Characterization NXG::Main Functions::Initializing App::Variable Resetting::Reset Disabled Controls.gvi
  Pika IV Characterization NXG::Main Functions::Initializing App::Variable Resetting::Reset Clusters.gvi
  Pika IV Characterization NXG::Main Functions::Initializing App::Variable Resetting::Reset Global Variables.gvi
  Pika IV Characterization NXG::Side Functions::Instrument Control::Instrument Detection Subroutine.gvi
  Pika IV Characterization NXG::Side Functions::Abort Control::FGV Global Abort.gvi
diagram:
  Property Node(instance in=$"Instrument Control Mega Cluster In") -> ("Debugging Cluster:Debugging mode?"=w1, "Debugging Cluster:Initialize App"=w2)
  Logical And(w1, not w2) -> w3
  # This is the Initialization Subroutine, its main job is to reset the values of controls, reset functional global variables, scan for instruments
  # and read configuration files among other things.
  case (w3) {
    frame True {
      w4 = $"Error In"
      w5 = $"Instrument Control Mega Cluster In"
      w6 = $"Misc Data Mega Cluster In"
    }
    frame False {
      case ($"Error In") {
        frame Error, Default {
          w4 = $"Error In"
          w5 = $"Instrument Control Mega Cluster In"
          w6 = $"Misc Data Mega Cluster In"
        }
        frame No Error {
          call "FGV Current State.gvi"(Current State Instructions="Set Current State", Current State="Initialize App", Error In=$"Error In") -> (Error Out=w7)
          call "Initialize App Instruction Extractor.gvi"(Initialize app subroutine states="Reset Disabled/Enabled Controls", Error In=w7) -> (Initialize App States Array=w8, SubStates Output Array=w9, Error Out=w10)
          s1 = w10  # shift register
          s2 = $"Instrument Control Mega Cluster In"  # shift register
          s3 = $"Misc Data Mega Cluster In"  # shift register
          for {
            w11 = each element of w8
            w12 = each element of w9
            call "FGV Current State.gvi"(Current State Instructions="Set Current Substate", Current Substate=w12, Error In=s1) -> (Error Out=w13)
            case (w11) {
              frame "Reset Disabled/Enabled Controls", Default {
                call "Reset Disabled Controls.gvi"(Misc Data Mega Cluster In=s3, Error In=w13) -> (Misc Data Mega Cluster Out=w16, Error Out=w14)
                w15 = s2
              }
              frame "Reset Doubles" {
                w14 = w13
                w15 = s2
                w16 = s3
              }
              frame "Reset Booleans" {
                w14 = w13
                w15 = s2
                w16 = s3
              }
              frame "Reset Clusters" {
                call "Reset Clusters.gvi"(Misc Data Mega Cluster In=s3, Error In=w13) -> (Misc Data Mega Cluster Out=w16, Error Out=w14)
                w15 = s2
              }
              frame "Reset Strings" {
                w14 = w13
                w15 = s2
                w16 = s3
              }
              frame "Reset Global Variables" {
                call "Reset Global Variables.gvi"(Error In=w13) -> (Error Out=w14)
                w15 = s2
                w16 = s3
              }
              frame "Detect Instruments" {
                call "Instrument Detection Subroutine.gvi"(Instrument Control Mega Cluster In=s2, Error In=w13) -> (Instrument Control Mega Cluster Out=w15, Error Out=w14)
                w16 = s3
              }
            }
            call "FGV Global Abort.gvi"(Global Abort Instructions="Read Current State", Error In=w14) -> (Global Abort Out=w17, Error Out=w18)
            next s1 = w18
            next s2 = w15
            next s3 = w16
            stop if w17
          }
          w4 = s1
          w5 = s2
          w6 = s3
        }
      }
    }
  }
  $"Instrument Control Mega Cluster Out" <- w5
  $"Error Out" <- w4
  $"Misc Data Mega Cluster Out" <- w6
