vi "Initialize Sample Naming.gvi"   [LabVIEW NXG 5.0.0]
inputs:
  "Error In": error
  "Misc Data Mega Cluster In": "Misc Mega Cluster.gtype"
outputs:
  "Error Out": error
  "Misc Data Mega Cluster Out": "Misc Mega Cluster.gtype"
types:
  "Full Reference Cluster.gtype" = cluster{"Status Report": "Status Report.gtype", "Path Cluster": "Path Cluster.gtype", "Sample Naming Cluster": "Sample Naming Cluster.gtype", "Acquisition Parameters": "Acquisition Parameters.gtype", "Live Progress Cluster": "Live Progress.gtype", "Sample Extra Information": "Sample extra imformation.gtype"}
  "Misc Mega Cluster.gtype" = cluster{"Full Reference Cluster": "Full Reference Cluster.gtype"}
diagram:
  # This SubVI Sets the tabs to the main tab so that the user starts where it has to
  case ($"Error In") {
    frame Error, Default {
      w1 = $"Error In"
      w2 = $"Misc Data Mega Cluster In"
    }
    frame No Error {
      Property Node(instance in=$"Misc Data Mega Cluster In") -> ("Full Reference Cluster:Status Report:Main Tab Reference"=w3, "Full Reference Cluster:Sample Naming Cluster:Cell Number"=w4, instance out=w2)
      Property Node(instance in=w3, "ValueSignaling"=0, error in=$"Error In") -> (error out=w5)
      Property Node(instance in=w4, "ValueSignaling"="", error in=w5) -> (error out=w1)
    }
  }
  $"Error Out" <- w1
  $"Misc Data Mega Cluster Out" <- w2
