vi "Reset Clusters.gvi"   [LabVIEW NXG 5.0.0]
inputs:
  "Error In": error
  "Misc Data Mega Cluster In": "Misc Mega Cluster.gtype"
outputs:
  "Error Out": error
  "Misc Data Mega Cluster Out": "Misc Mega Cluster.gtype"
types:
  T1 = cluster{"State Ref": "StringControl reference", "Substate Ref": "StringControl reference", "Current State Ref": "EnumSelector reference", "Main Tab Ref": "TabControl reference"}
  T2 = cluster{"Default Data Saving Location Ref": "PathSelector reference"}
  T3 = cluster{"Author Initials Ref": "ComboBoxSelector reference", "Batch Name Ref": "StringControl reference", "Cell Number Ref": "StringControl reference", "Current Date Ref": "StringControl reference", "Sample Comments Ref": "StringControl reference", "Sample Prefix Ref": "StringControl reference", "Custom Date Ref": "CheckBox reference", "Label Info Error Label Ref": "StringControl reference", "Label Info Missing Error Ref": "BooleanControl reference"}
  T4 = cluster{"Cell Parameters Ref": "Cluster reference", "Cell Selector Ref": "Cluster reference", "Measurement Precision Ref": "Cluster reference", "JV Scan Mode Ref": "EnumSelector reference"}
  T5 = cluster{"Live JV Parameters Ref": "Cluster reference", "Progress % Ref": "ProgressBar reference", "Progress Counter Ref": "NumericTextBoxDouble reference"}
  T6 = cluster{"Layer Information Ref": "ArrayViewer reference"[]}
  T7 = cluster{"Cell Selector Block Ref": "Rectangle reference", "Smart Mode Block Ref": "Rectangle reference", "dV Block Ref": "Rectangle reference", "Smart Mode Text Ref": "Text reference"}
  T8 = cluster{"JV Measurements Mega Cluster Ref": "Cluster reference", "Instrument Control Mega Cluster Ref": "Cluster reference"}
  "Full Reference Cluster.gtype" = cluster{"Status Report": T1, "Path Cluster": T2, "Sample Naming Cluster": T3, "Acquisition Parameters": T4, "Live Progress Cluster": T5, "Sample Extra Information": T6, "Visual Elements": T7, "Mega Cluster References": T8}
  "Misc Mega Cluster.gtype" = cluster{"Full Reference Cluster": "Full Reference Cluster.gtype"}
  "Cell Selector.gtype" = enum{"L.01", "L.02", "L.03", "L.04", "L.05", "L.06", "L.07", "L.08", "L.09", "L.10", "L.11", "L.12", "R.01", "R.02", "R.03", "R.04", "R.05", "R.06", "R.07", "R.08", "R.09", "R.10", "R.11", "R.12", "Custom"}
  "JV Data Cluster.gtype" = cluster{"Voltage (V)": f64[], "Current (A)": f64[], "Current Density (A/m^2)": f64[], "Cell Area (m^2)": f64, "Illumination (W/m^2)": f64, "Voc (V)": f64, "Jsc (A/m^2)": f64, "FF (%)": f64, "Rsh (Ω · m^2)": f64, "Rs (Ω · m^2)": f64, "Eff (%)": f64, "Measured Cell": "Cell Selector.gtype", "No Multiplexer": bool}
  "JV Scan Mode.gtype" = enum{"Rough", "Normal", "Accurate", "Smart", "Custom"}
  "JV Curve Parameters.gtype" = cluster{"JV Scan Mode": "JV Scan Mode.gtype", "Measurement Precision": "Accuracy Parameters.gtype", "Cell Parameters": "Cell Parameters.gtype"}
  "JV Measurements Mega Cluster.gtype" = cluster{"Cell Array": "Cell Selector.gtype"[], "JV Full Data Array": "JV Data Cluster.gtype"[], "Cell Selector": "Cell Selector.gtype", "JV Curve Parameters": "JV Curve Parameters.gtype"}
diagram:
  # This SubVI Resets some of the Clusters in the Main Window by using
  # references.
  case ($"Error In") {
    frame Error, Default {
      w1 = $"Error In"
      w2 = $"Misc Data Mega Cluster In"
    }
    frame No Error {
      Property Node(instance in=$"Misc Data Mega Cluster In") -> ("Full Reference Cluster:Mega Cluster References:JV Measurements Mega Cluster Ref"=w3, instance out=w2)
      Property Node(instance in=w3, "Value"="JV Measurements Mega Cluster.gtype" {all zero or empty}, error in=$"Error In") -> (error out=w1)
    }
  }
  $"Misc Data Mega Cluster Out" <- w2
  $"Error Out" <- w1
