vi "Reset Global Variables.gvi"   [LabVIEW NXG 5.0.0]
inputs:
  "Error In": error
outputs:
  "Error Out": error
uses:
  Pika IV Characterization NXG::Main Functions::JV Curve Full Subroutine::Initialization::FGV JV Operation.gvi
  Pika IV Characterization NXG::Side Functions::Abort Control::FGV Global Abort.gvi
  Pika IV Characterization NXG::Side Functions::Timeout::FGV Progress.gvi
  Pika IV Characterization NXG::Side Functions::Utilities::Cell Naming::FGV Sample Prefix.gvi
diagram:
  # This SubVI Resets all the Global Variables
  case ($"Error In") {
    frame Error, Default {
      w1 = $"Error In"
    }
    frame No Error {
      call "FGV JV Operation.gvi"(FGV Instructions="Reset State", Error In=$"Error In") -> (Error Out=w2)
      call "FGV Global Abort.gvi"(Global Abort Instructions="Reset State", Error In=w2) -> (Error Out=w3)
      call "FGV Progress.gvi"(FGV Instructions="Reset State", Error In=w3) -> (Error Out=w4)
      call "FGV Sample Prefix.gvi"(FGV Instructions="Reset State", Error In=w4) -> (Error Out=w1)
    }
  }
  $"Error Out" <- w1
