vi "Full JV Curve Measurement Subroutine.gvi"   [LabVIEW NXG 5.0.0]
inputs:
  "JV Measurements Mega Cluster In": "JV Measurements Mega Cluster.gtype" = {"Cell Array"=[], "JV Full Data Array"=[], "JV Curve Parameters"={1, -0.2, FALSE, 0.1, TRUE, 1, 8e-06, 1000, 100, 3, 0.5, 1, 0, 0}, "Cell Selector"={FALSE, FALSE, FALSE, FALSE, FALSE, FALSE, FALSE, FALSE, FALSE, FALSE, FALSE, FALSE, FALSE, FALSE, FALSE, FALSE, FALSE, FALSE, FALSE, FALSE, FALSE, FALSE, FALSE, FALSE, FALSE, FALSE, FALSE, FALSE, FALSE, FALSE}}
  "Instrument Control Mega Cluster In": "Instrument Control Mega Cluster.gtype"
  "Misc Data Mega Cluster In": "Misc Mega Cluster.gtype"
  "Error In": error
outputs:
  "Error Out": error
  "Misc Data Mega Cluster Out": "Misc Mega Cluster.gtype"
  "Instrument Control Mega Cluster Out": "Instrument Control Mega Cluster.gtype"
  "JV Measurements Mega Cluster Out": "JV Measurements Mega Cluster.gtype"
types:
  "Full Reference Cluster.gtype" = cluster{"Status Report": "Status Report.gtype", "Path Cluster": "Path Cluster.gtype", "Sample Naming Cluster": "Sample Naming Cluster.gtype", "Acquisition Parameters": "Acquisition Parameters.gtype", "Live Progress Cluster": "Live Progress.gtype", "Sample Extra Information": "Sample extra imformation.gtype"}
  "Misc Mega Cluster.gtype" = cluster{"Full Reference Cluster": "Full Reference Cluster.gtype"}
  T1 = cluster{"Element 1": "VISA Instr", "Element 2": string}
  T2 = enum{"Keithley 2400 Series", "Keithley 2450 Series"}
  "Instrument Control.gtype" = cluster{"Multiplexer Arduino Detected?": bool, "Multiplexer Arduino Address": "VISA Instr", "Arduinos List": T1[], "Multiplexer Log": string, "Keythley Address": "VISA Instr", "Keithley Detected?": bool, "Keithley ID": string, "Detected Keithley Type": T2}
  "Debugging Cluster.gtype" = cluster{"Debugging mode?": bool, "Initialize App": bool, "Insturment Debugging": cluster{"Keithley": bool, "Arduino": bool}}
  "Instrument Control Mega Cluster.gtype" = cluster{"Instrument Control": "Instrument Control.gtype", "Debugging Cluster": "Debugging Cluster.gtype"}
  "Cell Selector.gtype" = enum{"L.01", "L.02", "L.03", "L.04", "L.05", "L.06", "L.07", "L.08", "L.09", "L.10", "L.11", "L.12", "R.01", "R.02", "R.03", "R.04", "R.05", "R.06", "R.07", "R.08", "R.09", "R.10", "R.11", "R.12", "Custom"}
  "JV Data Cluster.gtype" = cluster{"Voltage (V)": f64[], "Current (A)": f64[], "Current Density (A/m^2)": f64[], "Cell Area (m^2)": f64, "Illumination (W/m^2)": f64, "Voc (V)": f64, "Jsc (A/m^2)": f64, "FF (%)": f64, "Rsh (Ω · m^2)": f64, "Rs (Ω · m^2)": f64, "Eff (%)": f64, "Measured Cell": "Cell Selector.gtype", "No Multiplexer": bool}
  "JV Scan Mode.gtype" = enum{"Rough", "Normal", "Accurate", "Smart", "Custom"}
  "JV Curve Parameters.gtype" = cluster{"Cell Parameters": "Cell Parameters.gtype", "Measurement Precision": "Accuracy Parameters.gtype", "JV Scan Mode": "JV Scan Mode.gtype"}
  "JV Measurements Mega Cluster.gtype" = cluster{"Cell Array": "Cell Selector.gtype"[], "JV Full Data Array": "JV Data Cluster.gtype"[], "JV Curve Parameters": "JV Curve Parameters.gtype", "Cell Selector": "Cell Selector.gtype"}
uses:
  Pika IV Characterization NXG::Main Functions::JV Curve Full Subroutine::Initialization::FGV JV Operation.gvi
  Pika IV Characterization NXG::Main Functions::Instruction Handling::FGV Current State.gvi
  Pika IV Characterization NXG::Main Functions::JV Curve Full Subroutine::Initialization::Reset JV Data Cluster.gvi
  Pika IV Characterization NXG::Main Functions::JV Curve Full Subroutine::State Machine::JV Measurements Abort Detect.gvi
  Pika IV Characterization NXG::Side Functions::Instrument Control::Keithley::Keithley Initialization Subroutine.gvi
  Pika IV Characterization NXG::Main Functions::JV Curve Full Subroutine::State Machine::JV Curves Aquiring::JV Curves Acquire Subroutine.gvi
  Pika IV Characterization NXG::Side Functions::Instrument Control::Keithley::Keithley Close Subroutine.gvi
  Pika IV Characterization NXG::Main Functions::JV Curve Full Subroutine::State Machine::Saving Data::JV Curve Save Prompt.gvi
  Pika IV Characterization NXG::Main Functions::JV Curve Full Subroutine::State Machine::Saving Data::JV File Saving Subroutine.gvi
  Pika IV Characterization NXG::Side Functions::Timeout::FGV Progress.gvi
diagram:
  # This SubVI Measures the Light power for each motor position for each sweep type and outputs the data so that it can be plotted
  # on the main window for checking and for calibration purposes
  case ($"Error In") {
    frame Error, Default {
      w1 = $"Error In"
      w2 = $"Instrument Control Mega Cluster In"
      w3 = $"JV Measurements Mega Cluster In"
      w4 = $"Misc Data Mega Cluster In"
    }
    frame No Error {
      call "FGV JV Operation.gvi"(FGV Instructions="Read State", Error In=$"Error In") -> (IV Operation Out=w5, Error Out=w6)
      call "FGV Current State.gvi"(Current State Instructions="Set Current State and Substate", Current State="IV Curves Acquisition", Current Substate="", Error In=w6) -> (Error Out=w7)
      call "Reset JV Data Cluster.gvi"(JV Measurements Mega Cluster In=$"JV Measurements Mega Cluster In", Error In=w7, JV Operation Selector=w5) -> (JV Measurements Mega Cluster Out=w8, Error Out=w9)
      s1 = w9  # shift register
      s2 = "Start App"  # shift register
      s3 = $"Instrument Control Mega Cluster In"  # shift register
      s4 = $"Misc Data Mega Cluster In"  # shift register
      s5 = w8  # shift register
      while {
        call "JV Measurements Abort Detect.gvi"(Previous State=s2, Error In=s1) -> (Next State=w10, Stop Loop=w11, Error Out=w12)
        case (w10) {
          frame "Start App", Default {
            w13 = s3
            w14 = w12
            w15 = s4
            w16 = s5
            w17 = "Initialize Instruments"
            w18 = default
          }
          frame "Initialize Instruments" {
            call "Keithley Initialization Subroutine.gvi"(Instrument Control Mega Cluster In=s3, Error In=w12) -> (Instrument Control Mega Cluster Out=w13, Error Out=w14)
            w15 = s4
            w16 = s5
            w17 = "Acquire IV Curves"
            w18 = default
          }
          frame "Acquire IV Curves" {
            call "JV Curves Acquire Subroutine.gvi"(Instrument Control Mega Cluster In=s3, JV Measurements Mega Cluster In=s5, Error In=w12) -> (Instrument Control Mega Cluster Out=w13, JV Measurements Mega Cluster Out=w16, Error Out=w14)
            w15 = s4
            w17 = "Close Coms"
            w18 = default
          }
          frame "Close Coms" {
            call "Keithley Close Subroutine.gvi"(Instrument Control Mega Cluster In=s3, Error In=w12) -> (Instrument Control Mega Cluster Out=w13, Error Out=w19)
            call "JV Curve Save Prompt.gvi"(Error In=w19) -> (Next State=w17, Error Out=w14)
            w15 = s4
            w16 = s5
            w18 = default
          }
          frame "Load Measurement" {
            w13 = s3
            w14 = w12
            w15 = s4
            w16 = s5
            w17 = default
            w18 = default
          }
          frame "Save Files" {
            call "JV File Saving Subroutine.gvi"(Misc Data Mega Cluster In=s4, JV Measurements Mega Cluster In=s5, Error In=w12) -> (Error Out=w14)
            w13 = s3
            w15 = s4
            w16 = s5
            w17 = "Stop App"
            w18 = default
          }
          frame "Stop App" {
            w13 = s3
            w14 = w12
            w15 = s4
            w16 = s5
            w17 = "Start App"
            w18 = TRUE
          }
        }
        call "FGV Progress.gvi"(FGV Instructions="Set State", Progress In=0, Error In=w14) -> (Error Out=w20)
        Logical Or(w11, w20, w18)
        next s1 = w20
        next s2 = w17
        next s3 = w13
        next s4 = w15
        next s5 = w16
        stop if w18
      }
      w1 = s1
      w2 = s3
      w3 = s5
      w4 = s4
    }
  }
  $"Instrument Control Mega Cluster Out" <- w2
  $"JV Measurements Mega Cluster Out" <- w3
  $"Error Out" <- w1
  $"Misc Data Mega Cluster Out" <- w4
