vi "Create Cell Array.gvi"   [LabVIEW NXG 5.0.0]
inputs:
  "Error In": error
  "JV Measurements Mega Cluster In": "JV Measurements Mega Cluster.gtype"
outputs:
  "Error Out": error
  "JV Measurements Mega Cluster Out": "JV Measurements Mega Cluster.gtype"
types:
  "Cell Selector.gtype" = enum{"L.01", "L.02", "L.03", "L.04", "L.05", "L.06", "L.07", "L.08", "L.09", "L.10", "L.11", "L.12", "R.01", "R.02", "R.03", "R.04", "R.05", "R.06", "R.07", "R.08", "R.09", "R.10", "R.11", "R.12", "Custom"}
  "JV Data Cluster.gtype" = cluster{"Voltage (V)": f64[], "Current (A)": f64[], "Current Density (A/m^2)": f64[], "Cell Area (m^2)": f64, "Illumination (W/m^2)": f64, "Voc (V)": f64, "Jsc (A/m^2)": f64, "FF (%)": f64, "Rsh (Ω · m^2)": f64, "Rs (Ω · m^2)": f64, "Eff (%)": f64, "Measured Cell": "Cell Selector.gtype", "No Multiplexer": bool}
  "JV Scan Mode.gtype" = enum{"Rough", "Normal", "Accurate", "Smart", "Custom"}
  "JV Curve Parameters.gtype" = cluster{"JV Scan Mode": "JV Scan Mode.gtype", "Measurement Precision": "Accuracy Parameters.gtype", "Cell Parameters": "Cell Parameters.gtype"}
  "JV Measurements Mega Cluster.gtype" = cluster{"Cell Array": "Cell Selector.gtype"[], "JV Full Data Array": "JV Data Cluster.gtype"[], "Cell Selector": "Cell Selector.gtype", "JV Curve Parameters": "JV Curve Parameters.gtype"}
uses:
  NI::G Core::Numeric::Random Number (Range) DBL.gvi
diagram:
  # This SubVI Generates the Cell array and randomizes it if desired
  case ($"Error In") {
    frame Error, Default {
      w1 = $"Error In"
      w2 = $"JV Measurements Mega Cluster In"
    }
    frame No Error {
      Property Node(instance in=$"JV Measurements Mega Cluster In") -> ("Cell Selector:Cell Cluster"=w3, "Cell Selector:Random Order "=w4, instance out=w5)
      Property Node(instance in=w3) -> ("L.01"=w6, "L.02"=w7, "L.03"=w8, "L.04"=w9, "L.05"=w10, "L.06"=w11, "L.07"=w12, "L.08"=w13, "L.09"=w14, "L.10"=w15, "L.11"=w16, "L.12"=w17, "R.01"=w18, "R.02"=w19, "R.03"=w20, "R.04"=w21, "R.05"=w22, "R.06"=w23, "R.07"=w24, "R.08"=w25, "R.09"=w26, "R.10"=w27, "R.11"=w28, "R.12"=w29)
      Build Array(w6, w7, w8, w9, w10, w11, w12, w13, w14, w15, w16, w17, w18, w19, w20, w21, w22, w23, w24, w25, w26, w27, w28, w29) -> w30
      for (iteration -> i1) {
        w31 = each element of w30
        To Unsigned 16 Bit Integer(number=i1) -> w33
        Type Cast(type="Cell Selector.gtype" "L.01", x=w33) -> w34
        append w34 to w32 if w31
      }
      case (w4) {
        frame False, Default {
          w35 = w32
        }
        frame True {
          Array Size(array=w32) -> (size(s)=w36)
          for (N = w36) {
            w37 = each element of w32
            To Double Precision Float(number=w36) -> w39
            call "Random Number (Range) DBL.gvi"(upper bound=w39) -> (number=w40)
            Build Cluster(w40, w37) -> w41
            append w41 to w38
          }
          Sort 1D Array(array=w38) -> (sorted array=w42)
          for {
            w43 = each element of w42
            Property Node(instance in=w43) -> ("Element 2"=w44)
            append w44 to w35
          }
        }
      }
      Property Node(instance in=w5, "Cell Array"=w35) -> (instance out=w2)
      w1 = $"Error In"
    }
  }
  $"Error Out" <- w1
  $"JV Measurements Mega Cluster Out" <- w2
