vi "Jsc and Voc.gvi"   [LabVIEW NXG 5.0.0]
inputs:
  "JV Data Cluster In": "JV Data Cluster.gtype"
  "JV Measurements Mega Cluster In": "JV Measurements Mega Cluster.gtype"
  "Error In": error
outputs:
  "JV Data Cluster Out": "JV Data Cluster.gtype"
  "JV Measurements Mega Cluster Out": "JV Measurements Mega Cluster.gtype"
  "Error Out": error
types:
  "Cell Selector.gtype" = enum{"L.01", "L.02", "L.03", "L.04", "L.05", "L.06", "L.07", "L.08", "L.09", "L.10", "L.11", "L.12", "R.01", "R.02", "R.03", "R.04", "R.05", "R.06", "R.07", "R.08", "R.09", "R.10", "R.11", "R.12", "Custom"}
  "JV Data Cluster.gtype" = cluster{"Voltage (V)": f64[], "Current (A)": f64[], "Current Density (A/m^2)": f64[], "Cell Area (m^2)": f64, "Illumination (W/m^2)": f64, "Voc (V)": f64, "Jsc (A/m^2)": f64, "FF (%)": f64, "Rsh (Ω · m^2)": f64, "Rs (Ω · m^2)": f64, "Eff (%)": f64, "Measured Cell": "Cell Selector.gtype", "No Multiplexer": bool}
  "JV Scan Mode.gtype" = enum{"Rough", "Normal", "Accurate", "Smart", "Custom"}
  "JV Curve Parameters.gtype" = cluster{"JV Scan Mode": "JV Scan Mode.gtype", "Measurement Precision": "Accuracy Parameters.gtype", "Cell Parameters": "Cell Parameters.gtype"}
  "JV Measurements Mega Cluster.gtype" = cluster{"Cell Array": "Cell Selector.gtype"[], "JV Full Data Array": "JV Data Cluster.gtype"[], "Cell Selector": "Cell Selector.gtype", "JV Curve Parameters": "JV Curve Parameters.gtype"}
uses:
  Pika IV Characterization NXG::Side Functions::Messages And Prompts::FGV Cancel Prompts until Finished Routine.gvi
  Pika IV Characterization NXG::Side Functions::Utilities::Array Handling::Find Closest In Array.gvi
  NI::Analysis::Fitting::Linear Fit.gvi
diagram:
  # This SubVI Takes the Voltage and the current data arrays and searches for the places where they cross both the x and the y axis. If found within tolerance we then obtain the suroulding
  # points for average and we perform a linear fit around those points to extract the parameters of the fitting line around those regions. With the parameters we extract the intersection points
  # for the Jsc and the Voc and we also extract the slopes for the Rs and the Rsh
  case ($"Error In") {
    frame Error, Default {
      w1 = $"Error In"
      w2 = $"JV Data Cluster In"
      w3 = $"JV Measurements Mega Cluster In"
    }
    frame No Error {
      Property Node(instance in=$"JV Data Cluster In") -> ("Voltage (V)"=w4, "Current Density (A/m^2)"=w5, instance out=w6)
      Property Node(instance in=$"JV Measurements Mega Cluster In") -> ("JV Curve Parameters:Measurement Precision:Rs Rsh Slope points"=w7, instance out=w3)
      call "FGV Cancel Prompts until Finished Routine.gvi"(Error In=$"Error In", FGV Instructions="Read State") -> (Prompt? Out=w8, Error Out=w9)
      Array Max And Min(array=w4) -> (max value=w10, min value=w11)
      Subtract(x=w10, y=w11) -> w12
      Divide(x=w12, y=6) -> w13
      call "Find Closest In Array.gvi"(Array In=w4, Desired Value=0, Tolerance=w13, Error In=w9) -> (Closest Value Index=w14, Within Tolerance?=w15, Error Out=w16)
      To Double Precision Float(number=w7) -> w17
      To Double Precision Float(number=2) -> w18
      Divide(x=w17, y=w18) -> w19
      Round Toward Negative Infinity(x=w19) -> w20
      To Signed 32 Bit Integer(number=w20) -> w21
      Array Max And Min(array=w5) -> (max value=w22, min value=w23)
      Subtract(x=w22, y=w23) -> w24
      Divide(x=w24, y=6) -> w25
      call "Find Closest In Array.gvi"(Array In=w5, Desired Value=0, Tolerance=w25, Error In=w16) -> (Closest Value Index=w26, Within Tolerance?=w27, Error Out=w28)
      Array Size(array=w4) -> (size(s)=w29)
      Add(w26, w21) -> w30
      Is Greater(x=w29, y=w30) -> w31
      Subtract(x=w26, y=w21) -> w32
      Is Greater Than 0(x=w32) -> w33
      Logical And(w31, w33) -> w34
      Array Size(array=w5) -> (size(s)=w35)
      Add(w14, w21) -> w36
      Is Greater(x=w35, y=w36) -> w37
      Subtract(x=w14, y=w21) -> w38
      Is Greater Than 0(x=w38) -> w39
      Logical And(w37, w39) -> w40
      Is Greater Than 0(x=w26) -> w41
      Is Greater Than 0(x=w14) -> w42
      Logical And(w34, w41, w40, w42, w15, w27) -> w43
      case (w43) {
        frame False, Default {
          w48 = "There have been some problems with the calculations of the Jsc and the Voc:"
          Concatenate Strings(w48, "\r", "\r") -> w49
          w50 = "The amount of points close to the J=0 region is insuficient. Try Extending the Electrical Sweep Range."
          Concatenate Strings(w50, "\r", "\r") -> w51
          Select(s=w34, t="", f=w51) -> w52
          w53 = "The amount of points close to the V=0 region is insuficient. Try Extending the Electrical Sweep Range."
          Concatenate Strings(w53, "\r", "\r") -> w54
          Select(s=w40, t="", f=w54) -> w55
          Logical And(w27, w41) -> w56
          w57 = "Could not find a point where J = 0 A. (J<0.01 A) Please make sure that the selected max and min Voltages are correct."
          Concatenate Strings(w57, "\r", "\r") -> w58
          Select(s=w56, t="", f=w58) -> w59
          Logical And(w15, w42) -> w60
          w61 = "Could not find a point where V = 0 V. (V<0.2 V) Please make sure that the selected max and min Voltages are correct."
          Concatenate Strings(w61, "\r", "\r") -> w62
          Select(s=w60, t="", f=w62) -> w63
          Concatenate Strings(w49, w52, w55, w59, w63) -> w64
          case (w8) {
            frame False, Default {
              w1 = w28
            }
            frame True {
              Two Button Dialog(F button name ("Cancel")="Okay you can stop\ntelling me this, thanks.", T button name ("OK")="Okay Sorry", message=w64) -> (T Button?=w65)
              call "FGV Cancel Prompts until Finished Routine.gvi"(Error In=w28, FGV Instructions="Set State", Prompt? In=w65) -> (Error Out=w1)
            }
          }
          w44 = default
          w45 = default
          w46 = default
          w47 = default
        }
        frame True {
          # w26: Voc Index
          Subtract(x=w26, y=w21) -> w66
          To Signed 32 Bit Integer(number=w7) -> w67
          To Signed 32 Bit Integer(number=w67) -> w68
          Array Subset(array=w5, index0=w66, length0=w68) -> w69
          # w4: Voltage Values
          Array Subset(array=w4, index0=w66, length0=w68) -> w70
          call "Linear Fit.gvi"(method="Least Square"(0), y=w69, x=w70, error in=w28) -> (slope=w71, intercept=w72, error out=w73)
          Reciprocal(x=w71) -> w74
          In Range And Coerce(lower limit=-0.001, upper limit=1000000, x=w74) -> (coerced(x)=w44)
          # w14: Jsc Index
          # w5: Current Density Values
          Subtract(x=w14, y=w21) -> w75
          To Signed 32 Bit Integer(number=w75) -> w76
          Array Subset(array=w5, index0=w76, length0=w67) -> w77
          Array Subset(array=w4, index0=w76, length0=w67) -> w78
          call "Linear Fit.gvi"(method="Least Square"(0), y=w77, x=w78, error in=w73) -> (slope=w79, intercept=w45, error out=w1)
          Reciprocal(x=w79) -> w80
          In Range And Coerce(lower limit=-0.001, upper limit=1000000, x=w80) -> (coerced(x)=w47)
          Negate(x=w72) -> w81
          Divide(x=w81, y=w71) -> w46
        }
      }
      Property Node(instance in=w6, "Rs (Ω · m^2)"=w44, "Rsh (Ω · m^2)"=w47, "Jsc (A/m^2)"=w45, "Voc (V)"=w46) -> (instance out=w2)
    }
  }
  $"JV Measurements Mega Cluster Out" <- w3
  $"JV Data Cluster Out" <- w2
  $"Error Out" <- w1
