vi "Check and Set Control Visibility.gvi"   [LabVIEW NXG 5.0.0]
inputs:
  "Error In": error
  "New Layer Prompt Ref Cluster In": "New Layer Prompt Ref Cluster.gtype"
outputs:
  "Error Out": error
  "New Layer Prompt Ref Cluster Out": "New Layer Prompt Ref Cluster.gtype"
types:
  "New Layer Prompt Ref Cluster.gtype" = cluster{"Add Layer Button Ref": "BooleanControl reference", "Blade Coating Controls Ref": "Cluster reference", "Deposition Method Ref": "EnumSelector reference", "General Controls Ref": "Cluster reference", "Layer Type Ref": "EnumSelector reference", "Solution Information Ref": "Cluster reference", "Spin Coating Controls Ref": "Cluster reference", "Thermal Evaporation Controls Ref": "Cluster reference", "This VI Ref": VIRefnum}
  "Control Visibility Cluster.gtype" = cluster{"Add Layer Position Button": cluster{"Left": f32, "Top": f32}, "Blade Controls Visible": bool, "General Controls Visible": bool, "Solution Inform Visible": bool, "Spin Coating Controls Visible": bool, "Thermal Evaporation Controls Visible": bool, "Panel Size": cluster{"Width": f32, "Height": f32}}
diagram:
  case ($"Error In") {
    frame Error, Default {
      w1 = $"Error In"
      w2 = $"New Layer Prompt Ref Cluster In"
    }
    frame No Error {
      Property Node(instance in=$"New Layer Prompt Ref Cluster In") -> ("Deposition Method Ref"=w3, instance out=w4)
      Property Node(instance in=w4) -> ("Add Layer Button Ref"=w5, "Blade Coating Controls Ref"=w6, "General Controls Ref"=w7, "Solution Information Ref"=w8, "Spin Coating Controls Ref"=w9, "Thermal Evaporation Controls Ref"=w10, "This VI Ref"=w11, instance out=w2)
      Property Node(instance in=w3, error in=$"Error In") -> ("Value"=w12, error out=w13)
      case (w12) {
        frame "E-beam Evaporation" {
          w15 = "Control Visibility Cluster.gtype" {"0x43920000", "0x43040000", FALSE, TRUE, FALSE, FALSE, FALSE, "0x43E60000", "0x43700000"}  # Control Visibility Cluster
          w14 = w15
        }
        frame "Sputtering" {
          w16 = "Control Visibility Cluster.gtype" {"0x43920000", "0x43040000", FALSE, TRUE, FALSE, FALSE, FALSE, "0x43E60000", "0x43700000"}  # Control Visibility Cluster
          w14 = w16
        }
        frame "Drop Casting" {
          w17 = "Control Visibility Cluster.gtype" {"0x43C80000", "0x42680000", FALSE, TRUE, TRUE, FALSE, FALSE, "0x44458000", "0x43FA0000"}  # Control Visibility Cluster
          w14 = w17
        }
        frame "Dip Coating" {
          w18 = "Control Visibility Cluster.gtype" {"0x43C80000", "0x42680000", FALSE, TRUE, TRUE, FALSE, FALSE, "0x44458000", "0x43FA0000"}  # Control Visibility Cluster
          w14 = w18
        }
        frame "Pulsed Laser Deposition" {
          w19 = "Control Visibility Cluster.gtype" {"0x43920000", "0x43040000", FALSE, TRUE, FALSE, FALSE, FALSE, "0x43E60000", "0x43700000"}  # Control Visibility Cluster
          w14 = w19
        }
        frame "Chemical Vapour Deposition" {
          w20 = "Control Visibility Cluster.gtype" {"0x43920000", "0x43040000", FALSE, TRUE, FALSE, FALSE, FALSE, "0x43E60000", "0x43700000"}  # Control Visibility Cluster
          w14 = w20
        }
        frame "Atomic Layer Deposition" {
          w21 = "Control Visibility Cluster.gtype" {"0x43920000", "0x43040000", FALSE, TRUE, FALSE, FALSE, FALSE, "0x43E60000", "0x43700000"}  # Control Visibility Cluster
          w14 = w21
        }
        frame "Spray Coating" {
          w22 = "Control Visibility Cluster.gtype" {"0x43C80000", "0x42680000", FALSE, TRUE, TRUE, FALSE, FALSE, "0x44458000", "0x43FA0000"}  # Control Visibility Cluster
          w14 = w22
        }
        frame "Screen Printing" {
          w23 = "Control Visibility Cluster.gtype" {"0x43C80000", "0x42680000", FALSE, TRUE, TRUE, FALSE, FALSE, "0x44458000", "0x43FA0000"}  # Control Visibility Cluster
          w14 = w23
        }
        frame "Electroplating" {
          w24 = "Control Visibility Cluster.gtype" {"0x43920000", "0x43040000", FALSE, TRUE, FALSE, FALSE, FALSE, "0x43E60000", "0x43700000"}  # Control Visibility Cluster
          w14 = w24
        }
        frame "Molecular Beam Epitaxy" {
          w25 = "Control Visibility Cluster.gtype" {"0x43920000", "0x43040000", FALSE, TRUE, FALSE, FALSE, FALSE, "0x43E60000", "0x43700000"}  # Control Visibility Cluster
          w14 = w25
        }
        frame "Custom Deposition" {
          w26 = "Control Visibility Cluster.gtype" {"0x43C80000", "0x42680000", FALSE, TRUE, TRUE, FALSE, FALSE, "0x44458000", "0x43FA0000"}  # Control Visibility Cluster
          w14 = w26
        }
        frame "Thermal Evaporation" {
          w27 = "Control Visibility Cluster.gtype" {"0x43920000", "0x43040000", FALSE, FALSE, FALSE, FALSE, TRUE, "0x43E60000", "0x438E8000"}  # Control Visibility Cluster
          w14 = w27
        }
        frame "Spin Coating" {
          w28 = "Control Visibility Cluster.gtype" {"0x43C80000", "0x42680000", FALSE, FALSE, TRUE, TRUE, FALSE, "0x44458000", "0x43FA0000"}  # Control Visibility Cluster
          w14 = w28
        }
        frame "Blade Coating", Default {
          w29 = "Control Visibility Cluster.gtype" {"0x43C80000", "0x42680000", TRUE, FALSE, TRUE, FALSE, FALSE, "0x44458000", "0x43FA0000"}  # Control Visibility Cluster
          w14 = w29
        }
      }
      Property Node(instance in=w14) -> ("Add Layer Position Button"=w30, "Blade Controls Visible"=w31, "General Controls Visible"=w32, "Solution Inform Visible"=w33, "Spin Coating Controls Visible"=w34, "Thermal Evaporation Controls Visible"=w35, "Panel Size"=w36)
      Property Node(instance in=w11, error in=w13) -> ("Panel"=w37, error out=w38)
      Property Node(instance in=w37, error in=w38) -> ("Window"=w39, error out=w40)
      Property Node(instance in=w39, "Size"=w36, error in=w40) -> (error out=w41)
      Property Node(instance in=w5, "Position"=w30, error in=w41) -> (error out=w42)
      Property Node(instance in=w6, "Visible"=w31, error in=w42) -> (error out=w43)
      Property Node(instance in=w7, "Visible"=w32, error in=w43) -> (error out=w44)
      Property Node(instance in=w10, "Visible"=w35, error in=w44) -> (error out=w45)
      Property Node(instance in=w8, "Visible"=w33, error in=w45) -> (error out=w46)
      Property Node(instance in=w9, "Visible"=w34, error in=w46) -> (error out=w1)
    }
  }
  $"Error Out" <- w1
  $"New Layer Prompt Ref Cluster Out" <- w2
