vi "Layer Information Cluster Subroutine.gvi"   [LabVIEW NXG 5.0.0]
inputs:
  "Error In": error
  "New Layer Prompt Ref Cluster In": "New Layer Prompt Ref Cluster.gtype"
  "Full Layer Information In": "Full Layer Information.gtype"
outputs:
  "Error Out": error
  "New Layer Prompt Ref Cluster Out": "New Layer Prompt Ref Cluster.gtype"
  "Full Layer Information Out": "Full Layer Information.gtype"
types:
  "New Layer Prompt Ref Cluster.gtype" = cluster{"Add Layer Button Ref": "BooleanControl reference", "This VI Ref": VIRefnum, "Blade Coating Parameters Ref": "Cluster reference", "Deposition Method Ref": "EnumSelector reference", "General Parameters Ref": "Cluster reference", "Layer Type ref": "EnumSelector reference", "Solution Information Ref": "Cluster reference", "Spin Coating Parameters Ref": "Cluster reference", "Thermal Evaporation Parameters Ref": "Cluster reference", "Load Layer File Ref": "BooleanControl reference", "Save Layer File Ref": "BooleanControl reference"}
  "Blade Coating Parameters.gtype" = cluster{"Thickness (nm)": f64, "Blade Initial Speed (mm/s)": f64, "Speed Gradient": bool, "Blade Final Speed (mm/s)": f64, "Blade Gap (um)": f64, "Blade Temperature (ºC)": f64, "Droplet Volume (ul)": f64, "Subsequent layers": f64, "Glovebox": bool, "Comments": string}
  "Deposition Method.gtype" = enum{"Blade Coating", "Spin Coating", "Thermal Evaporation", "E-beam Evaporation", "Sputtering", "Drop Casting", "Dip Coating", "Pulsed Laser Deposition", "Chemical Vapour Deposition", "Atomic Layer Deposition", "Spray Coating", "Screen Printing", "Electroplating", "Molecular Beam Epitaxy", "Custom Deposition"}
  "Layer Type.gtype" = enum{"Front Electrode", "Electrode Transport Layer", "Active Layer", "Hole Transport Layer", "Back Electrode", "Annealing Treatment", "Encapsulation", "Custom Layer"}
  "Spin Coating Parameters.gtype" = cluster{"Thickness (nm)": f64, "Spin Speed (rpm)": f64, "Dynamic Deposition": bool, "Spin Acceleration (rpm/s)": f64, "Droplet Volume (ul)": f64, "Subsequent layers": f64, "Glovebox": bool, "Comments": string}
  "Thermal Evaporation Parameters.gtype" = cluster{"Thickness (nm)": f64, "Deposition Rate (nm/s)": f64, "Comments": string, "Sample Rotation": bool, "Material": string}
  "Solution Information.gtype" = cluster{"Concentration (mg/ml)": f64, "Stirring Time (kr)": f64, "Glovebox": bool, "Composition Array": cluster{"Material": string, "Ratio": f64}[], "Solvent Array": cluster{"Solvent": string, "Ratio": f64}[], "Solution Preparation Date": f64, "Comments": string}
  "General Parameters.gtype" = cluster{"Thickness (nm)": f64, "Comments": string, "Material": string}
  "Useless Cluster.gtype" = cluster{"Blade Coating Information": bool, "General Information": bool, "Solution Information": bool, "Spin Coating Information": bool, "Thermal Evaporation Information": bool}
  "Full Layer Information.gtype" = cluster{"Blade Coating Parameters": "Blade Coating Parameters.gtype", "Deposition Method": "Deposition Method.gtype", "Layer Type": "Layer Type.gtype", "Spin Coating Parameters": "Spin Coating Parameters.gtype", "Thermal Evaporation Parameters": "Thermal Evaporation Parameters.gtype", "Solution Information": "Solution Information.gtype", "General Parameters": "General Parameters.gtype", "Current Deposition Method Information Cluster": "Useless Cluster.gtype", "Layer String ID": string}
uses:
  Pika IV Characterization NXG::Main Functions::Layer Composition::Data Management::Method Constant Selection.gvi
  Pika IV Characterization NXG::Main Functions::Layer Composition::Data Management::Layer String Generator.gvi
diagram:
  case ($"Error In") {
    frame Error, Default {
      w1 = $"Error In"
      w2 = $"New Layer Prompt Ref Cluster In"
      w3 = $"Full Layer Information In"
    }
    frame No Error {
      Property Node(instance in=$"New Layer Prompt Ref Cluster In") -> ("Deposition Method Ref"=w4, "Layer Type ref"=w5, "Blade Coating Parameters Ref"=w6, "Spin Coating Parameters Ref"=w7, "Solution Information Ref"=w8, "Thermal Evaporation Parameters Ref"=w9, "General Parameters Ref"=w10, instance out=w2)
      Property Node(instance in=w4, error in=$"Error In") -> ("Value"=w11, error out=w12)
      Property Node(instance in=w5, error in=w12) -> ("Value"=w13, error out=w14)
      Property Node(instance in=w8, error in=w14) -> ("Value"=w15, error out=w16)
      Property Node(instance in=w6, error in=w16) -> ("Value"=w17, error out=w18)
      Property Node(instance in=w7, error in=w18) -> ("Value"=w19, error out=w20)
      Property Node(instance in=w9, error in=w20) -> ("Value"=w21, error out=w22)
      Property Node(instance in=w10, error in=w22) -> ("Value"=w23, error out=w24)
      call "Method Constant Selection.gvi"(Deposition Method In=w11, Error In=w24) -> (Current Deposition Method Cluster Out=w25, Error Out=w26)
      Property Node(instance in=$"Full Layer Information In", "Blade Coating Parameters"=w17, "Deposition Method"=w11, "Layer Type"=w13, "Spin Coating Parameters"=w19, "Thermal Evaporation Parameters"=w21, "Solution Information"=w15, "General Parameters"=w23, "Current Deposition Method Information Cluster"=w25) -> (instance out=w27)
      call "Layer String Generator.gvi"(Full Layer Information In=w27, Error In=w26) -> (Full Layer Information Out=w3, Error Out=w1)
    }
  }
  $"New Layer Prompt Ref Cluster Out" <- w2
  $"Full Layer Information Out" <- w3
  $"Error Out" <- w1
