vi "Layer String Generator.gvi"   [LabVIEW NXG 5.0.0]
inputs:
  "Error In": error
  "Full Layer Information In": "Full Layer Information.gtype"
outputs:
  "Error Out": error
  "Full Layer Information Out": "Full Layer Information.gtype"
types:
  "Blade Coating Parameters.gtype" = cluster{"Thickness (nm)": f64, "Blade Initial Speed (mm/s)": f64, "Speed Gradient": bool, "Blade Final Speed (mm/s)": f64, "Blade Gap (um)": f64, "Blade Temperature (ºC)": f64, "Droplet Volume (ul)": f64, "Subsequent layers": f64, "Glovebox": bool, "Comments": string}
  "Deposition Method.gtype" = enum{"Blade Coating", "Spin Coating", "Thermal Evaporation", "E-beam Evaporation", "Sputtering", "Drop Casting", "Dip Coating", "Pulsed Laser Deposition", "Chemical Vapour Deposition", "Atomic Layer Deposition", "Spray Coating", "Screen Printing", "Electroplating", "Molecular Beam Epitaxy", "Custom Deposition"}
  "Layer Type.gtype" = enum{"Front Electrode", "Electrode Transport Layer", "Active Layer", "Hole Transport Layer", "Back Electrode", "Annealing Treatment", "Encapsulation", "Custom Layer"}
  "Spin Coating Parameters.gtype" = cluster{"Thickness (nm)": f64, "Spin Speed (rpm)": f64, "Dynamic Deposition": bool, "Spin Acceleration (rpm/s)": f64, "Droplet Volume (ul)": f64, "Subsequent layers": f64, "Glovebox": bool, "Comments": string}
  "Thermal Evaporation Parameters.gtype" = cluster{"Thickness (nm)": f64, "Deposition Rate (nm/s)": f64, "Comments": string, "Sample Rotation": bool, "Material": string}
  "Solution Information.gtype" = cluster{"Concentration (mg/ml)": f64, "Stirring Time (kr)": f64, "Glovebox": bool, "Composition Array": cluster{"Material": string, "Ratio": f64}[], "Solvent Array": cluster{"Solvent": string, "Ratio": f64}[], "Solution Preparation Date": f64, "Comments": string}
  "General Parameters.gtype" = cluster{"Thickness (nm)": f64, "Comments": string, "Material": string}
  "Useless Cluster.gtype" = cluster{"Blade Coating Information": bool, "General Information": bool, "Solution Information": bool, "Spin Coating Information": bool, "Thermal Evaporation Information": bool}
  "Full Layer Information.gtype" = cluster{"Blade Coating Parameters": "Blade Coating Parameters.gtype", "Deposition Method": "Deposition Method.gtype", "Layer Type": "Layer Type.gtype", "Spin Coating Parameters": "Spin Coating Parameters.gtype", "Thermal Evaporation Parameters": "Thermal Evaporation Parameters.gtype", "Solution Information": "Solution Information.gtype", "General Parameters": "General Parameters.gtype", "Current Deposition Method Information Cluster": "Useless Cluster.gtype", "Layer String ID": string}
uses:
  NI::G Core::Strings::Trim Whitespace.gvi
diagram:
  case ($"Error In") {
    frame Error, Default {
      w1 = $"Error In"
      w2 = $"Full Layer Information In"
    }
    frame No Error {
      Property Node(instance in=$"Full Layer Information In") -> ("Deposition Method"=w3, instance out=w4)
      case (w3) {
        frame "Blade Coating", Default {
          Property Node(instance in=w4) -> ("Solution Information:Composition Array"=w7, "Blade Coating Parameters:Thickness (nm)"=w8, "Blade Coating Parameters:Blade Initial Speed (mm/s)"=w9, "Blade Coating Parameters:Speed Gradient"=w10, "Blade Coating Parameters:Blade Final Speed (mm/s)"=w11, "Blade Coating Parameters:Comments"=w12, "Blade Coating Parameters:Blade Temperature (ºC)"=w13, instance out=w5)
          Is Empty Array(array=w7) -> w14
          case (w14) {
            frame True {
              w15 = "Unknown Material"
            }
            frame False {
              s1 = ""  # shift register
              for (iteration -> i1) {
                w16 = each element of w7
                Property Node(instance in=w16) -> ("Material"=w17)
                Is Greater Than 0(x=i1) -> w18
                Select(s=w18, t=":", f="") -> w19
                Concatenate Strings(s1, w19, w17) -> w20
                next s1 = w20
              }
              w15 = s1
            }
          }
          Number To Decimal String(number=w8) -> (decimal integer string=w21)
          Concatenate Strings(w21, " nm") -> w22
          Is Not Equal To 0(x=w8) -> w23
          Number To Decimal String(number=w9) -> (decimal integer string=w24)
          Number To Decimal String(number=w11) -> (decimal integer string=w25)
          Concatenate Strings(w24, "-", w25, " mm/s") -> w26
          Concatenate Strings(w24, " mm/s") -> w27
          Select(s=w10, t=w26, f=w27) -> w28
          Number To Decimal String(number=w13) -> (decimal integer string=w29)
          Concatenate Strings(w29, "ºC ", w28) -> w30
          Select(s=w23, t=w22, f=w30) -> w31
          Concatenate Strings(w15, "  ", w31, "  ", w12) -> w6
        }
        frame "Spin Coating" {
          Property Node(instance in=w4) -> ("Solution Information:Composition Array"=w32, "Spin Coating Parameters:Thickness (nm)"=w33, "Spin Coating Parameters:Spin Speed (rpm)"=w34, "Spin Coating Parameters:Dynamic Deposition"=w35, "Spin Coating Parameters:Comments"=w36, instance out=w5)
          Is Empty Array(array=w32) -> w37
          case (w37) {
            frame True {
              w38 = "Unknown Material"
            }
            frame False {
              s2 = ""  # shift register
              for (iteration -> i2) {
                w39 = each element of w32
                Property Node(instance in=w39) -> ("Material"=w40)
                Is Greater Than 0(x=i2) -> w41
                Select(s=w41, t=":", f="") -> w42
                Concatenate Strings(s2, w42, w40) -> w43
                next s2 = w43
              }
              w38 = s2
            }
          }
          Number To Decimal String(number=w33) -> (decimal integer string=w44)
          Concatenate Strings(w44, " nm") -> w45
          Number To Decimal String(number=w34) -> (decimal integer string=w46)
          Concatenate Strings(w46, "rpm Dyn ") -> w47
          Concatenate Strings(w46, "rpm") -> w48
          Select(s=w35, t=w47, f=w48) -> w49
          Is Not Equal To 0(x=w33) -> w50
          Select(s=w50, t=w45, f=w49) -> w51
          Concatenate Strings(w38, "  ", w51, "  ", w36) -> w6
        }
        frame "Dip Coating" {
          Property Node(instance in=w4) -> ("Solution Information:Composition Array"=w52, "General Parameters:Thickness (nm)"=w53, "General Parameters:Comments"=w54, instance out=w5)
          Is Empty Array(array=w52) -> w55
          case (w55) {
            frame True {
              w56 = "Unknown Material"
            }
            frame False {
              s3 = ""  # shift register
              for (iteration -> i3) {
                w57 = each element of w52
                Property Node(instance in=w57) -> ("Material"=w58)
                Is Greater Than 0(x=i3) -> w59
                Select(s=w59, t=":", f="") -> w60
                Concatenate Strings(s3, w60, w58) -> w61
                next s3 = w61
              }
              w56 = s3
            }
          }
          Is Not Equal To 0(x=w53) -> w62
          Number To Decimal String(number=w53) -> (decimal integer string=w63)
          Concatenate Strings(w63, " nm") -> w64
          Select(s=w62, t="", f=w64) -> w65
          Concatenate Strings(w56, "  ", w65, "  ", w54) -> w6
        }
        frame "Custom Deposition" {
          Property Node(instance in=w4) -> ("Solution Information:Composition Array"=w66, "General Parameters:Thickness (nm)"=w67, "General Parameters:Comments"=w68, instance out=w5)
          Is Empty Array(array=w66) -> w69
          case (w69) {
            frame True {
              w70 = "Unknown Material"
            }
            frame False {
              s4 = ""  # shift register
              for (iteration -> i4) {
                w71 = each element of w66
                Property Node(instance in=w71) -> ("Material"=w72)
                Is Greater Than 0(x=i4) -> w73
                Select(s=w73, t=":", f="") -> w74
                Concatenate Strings(s4, w74, w72) -> w75
                next s4 = w75
              }
              w70 = s4
            }
          }
          Is Equal To 0(x=w67) -> w76
          Number To Decimal String(number=w67) -> (decimal integer string=w77)
          Concatenate Strings(w77, " nm") -> w78
          Select(s=w76, t="", f=w78) -> w79
          Concatenate Strings(w70, "  ", w79, "  ", w68) -> w6
        }
        frame "Drop Casting" {
          Property Node(instance in=w4) -> ("Solution Information:Composition Array"=w80, "General Parameters:Thickness (nm)"=w81, "General Parameters:Comments"=w82, instance out=w5)
          Is Empty Array(array=w80) -> w83
          case (w83) {
            frame True {
              w84 = "Unknown Material"
            }
            frame False {
              s5 = ""  # shift register
              for (iteration -> i5) {
                w85 = each element of w80
                Property Node(instance in=w85) -> ("Material"=w86)
                Is Greater Than 0(x=i5) -> w87
                Select(s=w87, t=":", f="") -> w88
                Concatenate Strings(s5, w88, w86) -> w89
                next s5 = w89
              }
              w84 = s5
            }
          }
          Is Equal To 0(x=w81) -> w90
          Number To Decimal String(number=w81) -> (decimal integer string=w91)
          Concatenate Strings(w91, " nm") -> w92
          Select(s=w90, t="", f=w92) -> w93
          Concatenate Strings(w84, "  ", w93, "  ", w82) -> w6
        }
        frame "Spray Coating" {
          Property Node(instance in=w4) -> ("Solution Information:Composition Array"=w94, "General Parameters:Thickness (nm)"=w95, "General Parameters:Comments"=w96, instance out=w5)
          Is Empty Array(array=w94) -> w97
          case (w97) {
            frame True {
              w98 = "Unknown Material"
            }
            frame False {
              s6 = ""  # shift register
              for (iteration -> i6) {
                w99 = each element of w94
                Property Node(instance in=w99) -> ("Material"=w100)
                Is Greater Than 0(x=i6) -> w101
                Select(s=w101, t=":", f="") -> w102
                Concatenate Strings(s6, w102, w100) -> w103
                next s6 = w103
              }
              w98 = s6
            }
          }
          Is Equal To 0(x=w95) -> w104
          Number To Decimal String(number=w95) -> (decimal integer string=w105)
          Concatenate Strings(w105, " nm") -> w106
          Select(s=w104, t="", f=w106) -> w107
          Concatenate Strings(w98, "  ", w107, "  ", w96) -> w6
        }
        frame "Screen Printing" {
          Property Node(instance in=w4) -> ("Solution Information:Composition Array"=w108, "General Parameters:Thickness (nm)"=w109, "General Parameters:Comments"=w110, instance out=w5)
          Is Empty Array(array=w108) -> w111
          case (w111) {
            frame True {
              w112 = "Unknown Material"
            }
            frame False {
              s7 = ""  # shift register
              for (iteration -> i7) {
                w113 = each element of w108
                Property Node(instance in=w113) -> ("Material"=w114)
                Is Greater Than 0(x=i7) -> w115
                Select(s=w115, t=":", f="") -> w116
                Concatenate Strings(s7, w116, w114) -> w117
                next s7 = w117
              }
              w112 = s7
            }
          }
          Is Equal To 0(x=w109) -> w118
          Number To Decimal String(number=w109) -> (decimal integer string=w119)
          Concatenate Strings(w119, " nm") -> w120
          Select(s=w118, t="", f=w120) -> w121
          Concatenate Strings(w112, "  ", w121, "  ", w110) -> w6
        }
        frame "Thermal Evaporation" {
          Property Node(instance in=w4) -> ("Thermal Evaporation Parameters:Material"=w122, "Thermal Evaporation Parameters:Thickness (nm)"=w123, "Thermal Evaporation Parameters:Deposition Rate (nm/s)"=w124, "Thermal Evaporation Parameters:Comments"=w125, instance out=w5)
          call "Trim Whitespace.gvi"(string=w122) -> (trimmed string=w126)
          Is Empty String Or Path(string/path=w126) -> w127
          Select(s=w127, t="Unknown Material", f=w122) -> w128
          Number To Decimal String(number=w123) -> (decimal integer string=w129)
          Number To Decimal String(number=w124) -> (decimal integer string=w130)
          Concatenate Strings(w129, " nm ", w130, " nm/s") -> w131
          Is Equal To 0(x=w123) -> w132
          Select(s=w132, t="", f=w131) -> w133
          Concatenate Strings(w128, "  ", w133, "  ", w125) -> w6
        }
        frame "Pulsed Laser Deposition" {
          Property Node(instance in=w4) -> ("General Parameters:Material"=w134, "General Parameters:Thickness (nm)"=w135, "Thermal Evaporation Parameters:Comments"=w136, instance out=w5)
          call "Trim Whitespace.gvi"(string=w134) -> (trimmed string=w137)
          Is Empty String Or Path(string/path=w137) -> w138
          Select(s=w138, t="Unknown Material", f=w134) -> w139
          Is Equal To 0(x=w135) -> w140
          Number To Decimal String(number=w135) -> (decimal integer string=w141)
          Concatenate Strings(w141, " nm") -> w142
          Select(s=w140, t="", f=w142) -> w143
          Concatenate Strings(w139, "  ", w143, "  ", w136) -> w6
        }
        frame "Electroplating" {
          Property Node(instance in=w4) -> ("General Parameters:Material"=w144, "General Parameters:Thickness (nm)"=w145, "Thermal Evaporation Parameters:Comments"=w146, instance out=w5)
          call "Trim Whitespace.gvi"(string=w144) -> (trimmed string=w147)
          Is Empty String Or Path(string/path=w147) -> w148
          Select(s=w148, t="Unknown Material", f=w144) -> w149
          Is Equal To 0(x=w145) -> w150
          Number To Decimal String(number=w145) -> (decimal integer string=w151)
          Concatenate Strings(w151, " nm") -> w152
          Select(s=w150, t="", f=w152) -> w153
          Concatenate Strings(w149, "  ", w153, "  ", w146) -> w6
        }
        frame "Molecular Beam Epitaxy" {
          Property Node(instance in=w4) -> ("General Parameters:Material"=w154, "General Parameters:Thickness (nm)"=w155, "Thermal Evaporation Parameters:Comments"=w156, instance out=w5)
          call "Trim Whitespace.gvi"(string=w154) -> (trimmed string=w157)
          Is Empty String Or Path(string/path=w157) -> w158
          Select(s=w158, t="Unknown Material", f=w154) -> w159
          Is Equal To 0(x=w155) -> w160
          Number To Decimal String(number=w155) -> (decimal integer string=w161)
          Concatenate Strings(w161, " nm") -> w162
          Select(s=w160, t="", f=w162) -> w163
          Concatenate Strings(w159, "  ", w163, "  ", w156) -> w6
        }
        frame "E-beam Evaporation" {
          Property Node(instance in=w4) -> ("General Parameters:Material"=w164, "General Parameters:Thickness (nm)"=w165, "Thermal Evaporation Parameters:Comments"=w166, instance out=w5)
          call "Trim Whitespace.gvi"(string=w164) -> (trimmed string=w167)
          Is Empty String Or Path(string/path=w167) -> w168
          Select(s=w168, t="Unknown Material", f=w164) -> w169
          Is Equal To 0(x=w165) -> w170
          Number To Decimal String(number=w165) -> (decimal integer string=w171)
          Concatenate Strings(w171, " nm") -> w172
          Select(s=w170, t="", f=w172) -> w173
          Concatenate Strings(w169, "  ", w173, "  ", w166) -> w6
        }
        frame "Chemical Vapour Deposition" {
          Property Node(instance in=w4) -> ("General Parameters:Material"=w174, "General Parameters:Thickness (nm)"=w175, "Thermal Evaporation Parameters:Comments"=w176, instance out=w5)
          call "Trim Whitespace.gvi"(string=w174) -> (trimmed string=w177)
          Is Empty String Or Path(string/path=w177) -> w178
          Select(s=w178, t="Unknown Material", f=w174) -> w179
          Is Equal To 0(x=w175) -> w180
          Number To Decimal String(number=w175) -> (decimal integer string=w181)
          Concatenate Strings(w181, " nm") -> w182
          Select(s=w180, t="", f=w182) -> w183
          Concatenate Strings(w179, "  ", w183, "  ", w176) -> w6
        }
        frame "Sputtering" {
          Property Node(instance in=w4) -> ("General Parameters:Material"=w184, "General Parameters:Thickness (nm)"=w185, "Thermal Evaporation Parameters:Comments"=w186, instance out=w5)
          call "Trim Whitespace.gvi"(string=w184) -> (trimmed string=w187)
          Is Empty String Or Path(string/path=w187) -> w188
          Select(s=w188, t="Unknown Material", f=w184) -> w189
          Is Equal To 0(x=w185) -> w190
          Number To Decimal String(number=w185) -> (decimal integer string=w191)
          Concatenate Strings(w191, " nm") -> w192
          Select(s=w190, t="", f=w192) -> w193
          Concatenate Strings(w189, "  ", w193, "  ", w186) -> w6
        }
        frame "Atomic Layer Deposition" {
          Property Node(instance in=w4) -> ("General Parameters:Material"=w194, "General Parameters:Thickness (nm)"=w195, "Thermal Evaporation Parameters:Comments"=w196, instance out=w5)
          call "Trim Whitespace.gvi"(string=w194) -> (trimmed string=w197)
          Is Empty String Or Path(string/path=w197) -> w198
          Select(s=w198, t="Unknown Material", f=w194) -> w199
          Is Equal To 0(x=w195) -> w200
          Number To Decimal String(number=w195) -> (decimal integer string=w201)
          Concatenate Strings(w201, " nm") -> w202
          Select(s=w200, t="", f=w202) -> w203
          Concatenate Strings(w199, "  ", w203, "  ", w196) -> w6
        }
      }
      call "Trim Whitespace.gvi"(string=w6) -> (trimmed string=w204)
      Property Node(instance in=w5, "Layer String ID"=w204) -> (instance out=w2)
      w1 = $"Error In"
    }
  }
  $"Error Out" <- w1
  $"Full Layer Information Out" <- w2
