vi "Missing Information Check.gvi"   [LabVIEW NXG 5.0.0]
inputs:
  "Error In": error
  "Full Layer Information In": "Full Layer Information.gtype"
  "Layer Controls Prompt Ref Cluster In": "Layer Controls Prompt Ref Cluster.gtype"
outputs:
  "Error Out": error
  "Full Layer Information Out": "Full Layer Information.gtype"
  "Layer Controls Prompt Ref Cluster Out": "Layer Controls Prompt Ref Cluster.gtype"
  "Proceed?": bool
types:
  "Blade Coating Parameters.gtype" = cluster{"Thickness (nm)": f64, "Blade Initial Speed (mm/s)": f64, "Speed Gradient": bool, "Blade Final Speed (mm/s)": f64, "Blade Gap (um)": f64, "Blade Temperature (ºC)": f64, "Droplet Volume (ul)": f64, "Subsequent layers": f64, "Glovebox": bool, "Comments": string}
  "Deposition Method.gtype" = enum{"Blade Coating", "Spin Coating", "Thermal Evaporation", "E-beam Evaporation", "Sputtering", "Drop Casting", "Dip Coating", "Pulsed Laser Deposition", "Chemical Vapour Deposition", "Atomic Layer Deposition", "Spray Coating", "Screen Printing", "Electroplating", "Molecular Beam Epitaxy", "Custom Deposition"}
  "Layer Type.gtype" = enum{"Front Electrode", "Electrode Transport Layer", "Active Layer", "Hole Transport Layer", "Back Electrode", "Annealing Treatment", "Encapsulation", "Custom Layer"}
  "Spin Coating Parameters.gtype" = cluster{"Thickness (nm)": f64, "Spin Speed (rpm)": f64, "Dynamic Deposition": bool, "Spin Acceleration (rpm/s)": f64, "Droplet Volume (ul)": f64, "Subsequent layers": f64, "Glovebox": bool, "Comments": string}
  "Thermal Evaporation Parameters.gtype" = cluster{"Thickness (nm)": f64, "Deposition Rate (nm/s)": f64, "Comments": string, "Sample Rotation": bool, "Material": string}
  "Solution Information.gtype" = cluster{"Concentration (mg/ml)": f64, "Stirring Time (kr)": f64, "Glovebox": bool, "Composition Array": cluster{"Material": string, "Ratio": f64}[], "Solvent Array": cluster{"Solvent": string, "Ratio": f64}[], "Solution Preparation Date": f64, "Comments": string}
  "General Parameters.gtype" = cluster{"Thickness (nm)": f64, "Comments": string, "Material": string}
  "Useless Cluster.gtype" = cluster{"Blade Coating Information": bool, "General Information": bool, "Solution Information": bool, "Spin Coating Information": bool, "Thermal Evaporation Information": bool}
  "Full Layer Information.gtype" = cluster{"Blade Coating Parameters": "Blade Coating Parameters.gtype", "Deposition Method": "Deposition Method.gtype", "Layer Type": "Layer Type.gtype", "Spin Coating Parameters": "Spin Coating Parameters.gtype", "Thermal Evaporation Parameters": "Thermal Evaporation Parameters.gtype", "Solution Information": "Solution Information.gtype", "General Parameters": "General Parameters.gtype", "Current Deposition Method Information Cluster": "Useless Cluster.gtype", "Layer String ID": string}
  "Layer Controls Prompt Ref Cluster.gtype" = cluster{"Add Layer Button Ref": "BooleanControl reference", "This VI Ref": VIRefnum, "Blade Coating Parameters Ref": "Cluster reference", "Deposition Method Ref": "EnumSelector reference", "General Parameters Ref": "Cluster reference", "Layer Type ref": "EnumSelector reference", "Solution Information Ref": "Cluster reference", "Spin Coating Parameters Ref": "Cluster reference", "Thermal Evaporation Parameters Ref": "Cluster reference", "Load Layer File Ref": "BooleanControl reference", "Save Layer File Ref": "BooleanControl reference", "Layer To Edit Ref": "RingSelectorInt32 reference"}
uses:
  Pika IV Characterization NXG::Main Functions::Layer Composition::Data Management::Missing info::Front Electrode Default Check.gvi
  Pika IV Characterization NXG::Main Functions::Layer Composition::Data Management::Missing info::Missing Deposition Info.gvi
  Pika IV Characterization NXG::Main Functions::Layer Composition::Data Management::Missing info::Missing Solution Info.gvi
  Pika IV Characterization NXG::Main Functions::Layer Composition::Data Management::Missing info::Prompt Generator.gvi
diagram:
  # This SubVI Checks if there is any missing information depending on the layer type and if there is
  # it prompts the user if it wants to proceed withoud adding the infomration or not.
  # It outputs the result as a boolean
  case ($"Error In") {
    frame Error, Default {
      w1 = $"Error In"
      w2 = $"Full Layer Information In"
      w3 = $"Layer Controls Prompt Ref Cluster In"
      w4 = default
    }
    frame No Error {
      Property Node(instance in=$"Full Layer Information In") -> ("Layer Type"=w5, "Deposition Method"=w6, instance out=w7)
      case (w5) {
        frame "Front Electrode" {
          call "Front Electrode Default Check.gvi"(Layer Controls Reference Cluster In=$"Layer Controls Prompt Ref Cluster In", Full Layer Info In=w7, Deposition Method=w6, Error In=$"Error In") -> (Proceed?=w4, Layer Controls Reference Cluster Out=w3, Full Layer Info Out=w2, Error Out=w1)
        }
        frame Default {
          call "Missing Deposition Info.gvi"(Full Layer Information In=w7, Error In=$"Error In", Deposition Method=w6) -> (Full Layer Information Out=w8, Output Prompt=w9, Layer Deposition Information Missing?=w10, Error Out=w11)
          call "Missing Solution Info.gvi"(Full Layer Information In=w8, Error In=w11, Deposition Method=w6) -> (Full Layer Information Out=w2, Output Prompt=w12, Solution Information Missing?=w13, Error Out=w14)
          call "Prompt Generator.gvi"(Deposition Method=w6, Layer Info Prompt=w9, Solution Info Prompt=w12, Error In=w14, Missing Solution Info?=w13, Missing Layer Info?=w10) -> (Proceed?=w4, Error Out=w1)
          w3 = $"Layer Controls Prompt Ref Cluster In"
        }
      }
    }
  }
  $"Proceed?" <- w4
  $"Layer Controls Prompt Ref Cluster Out" <- w3
  $"Full Layer Information Out" <- w2
  $"Error Out" <- w1
