vi "Single File Load.gvi"   [LabVIEW NXG 5.0.0]
inputs:
  "Error In": error
  "Full Layer Information In": "Full Layer Information.gtype"
  "Layer Type Data Path": path
outputs:
  "Error Out": error
  "Full Layer Information Out": "Full Layer Information.gtype"
types:
  "Blade Coating Parameters.gtype" = cluster{"Thickness (nm)": f64, "Blade Initial Speed (mm/s)": f64, "Speed Gradient": bool, "Blade Final Speed (mm/s)": f64, "Blade Gap (um)": f64, "Blade Temperature (ºC)": f64, "Droplet Volume (ul)": f64, "Subsequent layers": f64, "Glovebox": bool, "Comments": string}
  "Deposition Method.gtype" = enum{"Blade Coating", "Spin Coating", "Thermal Evaporation", "E-beam Evaporation", "Sputtering", "Drop Casting", "Dip Coating", "Pulsed Laser Deposition", "Chemical Vapour Deposition", "Atomic Layer Deposition", "Spray Coating", "Screen Printing", "Electroplating", "Molecular Beam Epitaxy", "Custom Deposition"}
  "Layer Type.gtype" = enum{"Front Electrode", "Electron Transport Layer", "Active Layer", "Hole Transport Layer", "Back Electrode", "Custom Layer"}
  "Spin Coating Parameters.gtype" = cluster{"Thickness (nm)": f64, "Spin Speed (rpm)": f64, "Dynamic Deposition": bool, "Spin Acceleration (rpm/s)": f64, "Droplet Volume (ul)": f64, "Subsequent layers": f64, "Glovebox": bool, "Comments": string, "Spin Time (s)": f64}
  "Thermal Evaporation Parameters.gtype" = cluster{"Thickness (nm)": f64, "Deposition Rate (nm/s)": f64, "Comments": string, "Sample Rotation": bool, "Material": string}
  "Solution Information.gtype" = cluster{"Concentration (mg/ml)": f64, "Stir Time (kr)": f64, "Composition Array": cluster{"Material": string, "Ratio": f64}[], "Solvent Array": cluster{"Solvent": string, "Ratio": f64}[], "Solution Preparation Date": string, "Comments": string, "Stir Temp (ºC)": f64, "Glovebox": bool, "Solution Label": string, "Solution Descriptor": string, "Volume (ul)": f64}
  "General Parameters.gtype" = cluster{"Thickness (nm)": f64, "Comments": string, "Material": string}
  "Useless Cluster.gtype" = cluster{"Blade Coating Information": bool, "General Information": bool, "Solution Information": bool, "Spin Coating Information": bool, "Thermal Evaporation Information": bool}
  "Full Layer Information.gtype" = cluster{"Blade Coating Parameters": "Blade Coating Parameters.gtype", "Deposition Method": "Deposition Method.gtype", "Layer Type": "Layer Type.gtype", "Spin Coating Parameters": "Spin Coating Parameters.gtype", "Thermal Evaporation Parameters": "Thermal Evaporation Parameters.gtype", "Solution Information": "Solution Information.gtype", "General Parameters": "General Parameters.gtype", "Current Deposition Method Information Cluster": "Useless Cluster.gtype", "Layer String ID": string}
uses:
  NI::G Core::Configuration File (INI)::Open Config Data.gvi
  NI::G Core::Configuration File (INI)::Read Key::Read Key (String).gvi
  Pika IV Characterization NXG::Main Functions::Layer Composition::File Management::Low Level::String to Layer Information.gvi
  Pika IV Characterization NXG::Main Functions::Layer Composition::File Management::Low Level::Load Config Parser.gvi
  NI::G Core::Configuration File (INI)::Close Config Data.gvi
diagram:
  # This SubVI Loads the information from a given configuration file into the full layer information cluster.
  case ($"Error In") {
    frame Error, Default {
      w1 = $"Error In"
      w2 = $"Full Layer Information In"
    }
    frame No Error {
      call "Open Config Data.gvi"(configuration file=$"Layer Type Data Path", error in=$"Error In") -> (reference=w3, error out=w4)
      call "Read Key (String).gvi"(reference in=w3, key="Layer String ID", error in=w4, section="General Information") -> (reference out=w5, value=w6, error out=w7)
      call "Read Key (String).gvi"(reference in=w5, key="Deposition Method", error in=w7, section="General Information") -> (reference out=w8, value=w9, error out=w10)
      call "String to Layer Information.gvi"(Info To Retreive="Deposition Method", String To Convert=w9, Error In=w10) -> (Deposition Method=w11, Error Out=w12)
      call "Read Key (String).gvi"(reference in=w8, key="Layer Type", error in=w12, section="General Information") -> (reference out=w13, value=w14, error out=w15)
      call "String to Layer Information.gvi"(Info To Retreive="Layer Type", String To Convert=w14, Error In=w15) -> (Layer Type=w16, Error Out=w17)
      Property Node(instance in=$"Full Layer Information In", "Layer String ID"=w6, "Deposition Method"=w11, "Layer Type"=w16) -> (instance out=w18)
      case (w11) {
        frame "Blade Coating", Default {
          call "Load Config Parser.gvi"(Full Layer Information In=w18, Config File In=w13, Error In=w17, Config Types="Blade Coating Parameters") -> (Full Layer Information Out=w21, Config File Ref Out=w22, Error Out=w23)
          call "Load Config Parser.gvi"(Full Layer Information In=w21, Config File In=w22, Error In=w23, Config Types="Solution Parameters") -> (Full Layer Information Out=w2, Config File Ref Out=w20, Error Out=w19)
        }
        frame "Drop Casting" {
          call "Load Config Parser.gvi"(Full Layer Information In=w18, Config File In=w13, Error In=w17, Config Types="General Parameters") -> (Full Layer Information Out=w24, Config File Ref Out=w25, Error Out=w26)
          call "Load Config Parser.gvi"(Full Layer Information In=w24, Config File In=w25, Error In=w26, Config Types="Solution Parameters") -> (Full Layer Information Out=w2, Config File Ref Out=w20, Error Out=w19)
        }
        frame "Dip Coating" {
          call "Load Config Parser.gvi"(Full Layer Information In=w18, Config File In=w13, Error In=w17, Config Types="General Parameters") -> (Full Layer Information Out=w27, Config File Ref Out=w28, Error Out=w29)
          call "Load Config Parser.gvi"(Full Layer Information In=w27, Config File In=w28, Error In=w29, Config Types="Solution Parameters") -> (Full Layer Information Out=w2, Config File Ref Out=w20, Error Out=w19)
        }
        frame "Custom Deposition" {
          call "Load Config Parser.gvi"(Full Layer Information In=w18, Config File In=w13, Error In=w17, Config Types="General Parameters") -> (Full Layer Information Out=w30, Config File Ref Out=w31, Error Out=w32)
          call "Load Config Parser.gvi"(Full Layer Information In=w30, Config File In=w31, Error In=w32, Config Types="Solution Parameters") -> (Full Layer Information Out=w2, Config File Ref Out=w20, Error Out=w19)
        }
        frame "Spray Coating" {
          call "Load Config Parser.gvi"(Full Layer Information In=w18, Config File In=w13, Error In=w17, Config Types="General Parameters") -> (Full Layer Information Out=w33, Config File Ref Out=w34, Error Out=w35)
          call "Load Config Parser.gvi"(Full Layer Information In=w33, Config File In=w34, Error In=w35, Config Types="Solution Parameters") -> (Full Layer Information Out=w2, Config File Ref Out=w20, Error Out=w19)
        }
        frame "Screen Printing" {
          call "Load Config Parser.gvi"(Full Layer Information In=w18, Config File In=w13, Error In=w17, Config Types="General Parameters") -> (Full Layer Information Out=w36, Config File Ref Out=w37, Error Out=w38)
          call "Load Config Parser.gvi"(Full Layer Information In=w36, Config File In=w37, Error In=w38, Config Types="Solution Parameters") -> (Full Layer Information Out=w2, Config File Ref Out=w20, Error Out=w19)
        }
        frame "Spin Coating" {
          call "Load Config Parser.gvi"(Full Layer Information In=w18, Config File In=w13, Error In=w17, Config Types="Spin Coating Parameters") -> (Full Layer Information Out=w39, Config File Ref Out=w40, Error Out=w41)
          call "Load Config Parser.gvi"(Full Layer Information In=w39, Config File In=w40, Error In=w41, Config Types="Solution Parameters") -> (Full Layer Information Out=w2, Config File Ref Out=w20, Error Out=w19)
        }
        frame "Thermal Evaporation" {
          call "Load Config Parser.gvi"(Full Layer Information In=w18, Config File In=w13, Error In=w17, Config Types="Thermal Evaporation Parameters") -> (Full Layer Information Out=w2, Config File Ref Out=w20, Error Out=w19)
        }
        frame "E-beam Evaporation" {
          call "Load Config Parser.gvi"(Full Layer Information In=w18, Config File In=w13, Error In=w17, Config Types="General Parameters") -> (Full Layer Information Out=w2, Config File Ref Out=w20, Error Out=w19)
        }
        frame "Electroplating" {
          call "Load Config Parser.gvi"(Full Layer Information In=w18, Config File In=w13, Error In=w17, Config Types="General Parameters") -> (Full Layer Information Out=w2, Config File Ref Out=w20, Error Out=w19)
        }
        frame "Molecular Beam Epitaxy" {
          call "Load Config Parser.gvi"(Full Layer Information In=w18, Config File In=w13, Error In=w17, Config Types="General Parameters") -> (Full Layer Information Out=w2, Config File Ref Out=w20, Error Out=w19)
        }
        frame "Pulsed Laser Deposition" {
          call "Load Config Parser.gvi"(Full Layer Information In=w18, Config File In=w13, Error In=w17, Config Types="General Parameters") -> (Full Layer Information Out=w2, Config File Ref Out=w20, Error Out=w19)
        }
        frame "Chemical Vapour Deposition" {
          call "Load Config Parser.gvi"(Full Layer Information In=w18, Config File In=w13, Error In=w17, Config Types="General Parameters") -> (Full Layer Information Out=w2, Config File Ref Out=w20, Error Out=w19)
        }
        frame "Atomic Layer Deposition" {
          call "Load Config Parser.gvi"(Full Layer Information In=w18, Config File In=w13, Error In=w17, Config Types="General Parameters") -> (Full Layer Information Out=w2, Config File Ref Out=w20, Error Out=w19)
        }
        frame "Sputtering" {
          call "Load Config Parser.gvi"(Full Layer Information In=w18, Config File In=w13, Error In=w17, Config Types="General Parameters") -> (Full Layer Information Out=w2, Config File Ref Out=w20, Error Out=w19)
        }
      }
      call "Close Config Data.gvi"(reference=w20, error in=w19) -> (error out=w1)
    }
  }
  $"Full Layer Information Out" <- w2
  $"Error Out" <- w1
