vi "Single File Save.gvi"   [LabVIEW NXG 5.0.0]
inputs:
  "Error In": error
  "Full Layer Information In": "Full Layer Information.gtype"
  "Layer Type Data Path": path
  "Prompt?": bool = TRUE
outputs:
  "Error Out": error
types:
  "Blade Coating Parameters.gtype" = cluster{"Thickness (nm)": f64, "Blade Initial Speed (mm/s)": f64, "Speed Gradient": bool, "Blade Final Speed (mm/s)": f64, "Blade Gap (um)": f64, "Blade Temperature (ºC)": f64, "Droplet Volume (ul)": f64, "Subsequent layers": f64, "Glovebox": bool, "Comments": string}
  "Deposition Method.gtype" = enum{"Blade Coating", "Spin Coating", "Thermal Evaporation", "E-beam Evaporation", "Sputtering", "Drop Casting", "Dip Coating", "Pulsed Laser Deposition", "Chemical Vapour Deposition", "Atomic Layer Deposition", "Spray Coating", "Screen Printing", "Electroplating", "Molecular Beam Epitaxy", "Custom Deposition"}
  "Layer Type.gtype" = enum{"Front Electrode", "Electron Transport Layer", "Active Layer", "Hole Transport Layer", "Back Electrode", "Custom Layer"}
  "Spin Coating Parameters.gtype" = cluster{"Thickness (nm)": f64, "Spin Speed (rpm)": f64, "Dynamic Deposition": bool, "Spin Acceleration (rpm/s)": f64, "Droplet Volume (ul)": f64, "Subsequent layers": f64, "Glovebox": bool, "Comments": string, "Spin Time (s)": f64}
  "Thermal Evaporation Parameters.gtype" = cluster{"Thickness (nm)": f64, "Deposition Rate (nm/s)": f64, "Comments": string, "Sample Rotation": bool, "Material": string}
  "Solution Information.gtype" = cluster{"Concentration (mg/ml)": f64, "Stir Time (kr)": f64, "Composition Array": cluster{"Material": string, "Ratio": f64}[], "Solvent Array": cluster{"Solvent": string, "Ratio": f64}[], "Solution Preparation Date": string, "Comments": string, "Stir Temp (ºC)": f64, "Glovebox": bool, "Solution Label": string, "Solution Descriptor": string, "Volume (ul)": f64}
  "General Parameters.gtype" = cluster{"Thickness (nm)": f64, "Comments": string, "Material": string}
  "Useless Cluster.gtype" = cluster{"Blade Coating Information": bool, "General Information": bool, "Solution Information": bool, "Spin Coating Information": bool, "Thermal Evaporation Information": bool}
  "Full Layer Information.gtype" = cluster{"Blade Coating Parameters": "Blade Coating Parameters.gtype", "Deposition Method": "Deposition Method.gtype", "Layer Type": "Layer Type.gtype", "Spin Coating Parameters": "Spin Coating Parameters.gtype", "Thermal Evaporation Parameters": "Thermal Evaporation Parameters.gtype", "Solution Information": "Solution Information.gtype", "General Parameters": "General Parameters.gtype", "Current Deposition Method Information Cluster": "Useless Cluster.gtype", "Layer String ID": string}
uses:
  NI::G Core::Configuration File (INI)::Open Config Data.gvi
  NI::G Core::Configuration File (INI)::Write Key::Write Key (String).gvi
  Pika IV Characterization NXG::Main Functions::Layer Composition::File Management::Low Level::Save Config Parser.gvi
  NI::G Core::Configuration File (INI)::Close Config Data.gvi
  Pika IV Characterization NXG::Side Functions::Messages And Prompts::General Simple Prompt.gvi
diagram:
  # This SubVI Takes care of saving all the layer information into a config file so that it can be loaded afterwards
  case ($"Error In") {
    frame Error, Default {
      w1 = $"Error In"
    }
    frame No Error {
      Property Node(instance in=$"Full Layer Information In") -> ("Layer String ID"=w2, "Deposition Method"=w3, "Layer Type"=w4, instance out=w5)
      call "Open Config Data.gvi"(configuration file=$"Layer Type Data Path", error in=$"Error In") -> (reference=w6, error out=w7)
      call "Write Key (String).gvi"(reference in=w6, key="Layer String ID", value=w2, error in=w7, section="General Information") -> (reference out=w8, error out=w9)
      Format Into String(errIn=w9, w4) -> (outString=w10, errOut=w11)
      call "Write Key (String).gvi"(reference in=w8, key="Layer Type", value=w10, error in=w11, section="General Information") -> (reference out=w12, error out=w13)
      Format Into String(errIn=w13, w3) -> (outString=w14, errOut=w15)
      call "Write Key (String).gvi"(reference in=w12, key="Deposition Method", value=w14, error in=w15, section="General Information") -> (reference out=w16, error out=w17)
      case (w3) {
        frame "Spin Coating" {
          call "Save Config Parser.gvi"(Full Layer Information In=w5, Config File In=w16, Error In=w17, Config Types="Spin Coating Parameters") -> (Full Layer Information Out=w20, Config File Ref Out=w21, Error Out=w22)
          call "Save Config Parser.gvi"(Full Layer Information In=w20, Config File In=w21, Error In=w22, Config Types="Solution Parameters") -> (Config File Ref Out=w19, Error Out=w18)
        }
        frame "Blade Coating", Default {
          call "Save Config Parser.gvi"(Full Layer Information In=w5, Config File In=w16, Error In=w17, Config Types="Blade Coating Parameters") -> (Full Layer Information Out=w23, Config File Ref Out=w24, Error Out=w25)
          call "Save Config Parser.gvi"(Full Layer Information In=w23, Config File In=w24, Error In=w25, Config Types="Solution Parameters") -> (Config File Ref Out=w19, Error Out=w18)
        }
        frame "Drop Casting" {
          call "Save Config Parser.gvi"(Full Layer Information In=w5, Config File In=w16, Error In=w17, Config Types="General Parameters") -> (Full Layer Information Out=w26, Config File Ref Out=w27, Error Out=w28)
          call "Save Config Parser.gvi"(Full Layer Information In=w26, Config File In=w27, Error In=w28, Config Types="Solution Parameters") -> (Config File Ref Out=w19, Error Out=w18)
        }
        frame "Dip Coating" {
          call "Save Config Parser.gvi"(Full Layer Information In=w5, Config File In=w16, Error In=w17, Config Types="General Parameters") -> (Full Layer Information Out=w29, Config File Ref Out=w30, Error Out=w31)
          call "Save Config Parser.gvi"(Full Layer Information In=w29, Config File In=w30, Error In=w31, Config Types="Solution Parameters") -> (Config File Ref Out=w19, Error Out=w18)
        }
        frame "Custom Deposition" {
          call "Save Config Parser.gvi"(Full Layer Information In=w5, Config File In=w16, Error In=w17, Config Types="General Parameters") -> (Full Layer Information Out=w32, Config File Ref Out=w33, Error Out=w34)
          call "Save Config Parser.gvi"(Full Layer Information In=w32, Config File In=w33, Error In=w34, Config Types="Solution Parameters") -> (Config File Ref Out=w19, Error Out=w18)
        }
        frame "Spray Coating" {
          call "Save Config Parser.gvi"(Full Layer Information In=w5, Config File In=w16, Error In=w17, Config Types="General Parameters") -> (Full Layer Information Out=w35, Config File Ref Out=w36, Error Out=w37)
          call "Save Config Parser.gvi"(Full Layer Information In=w35, Config File In=w36, Error In=w37, Config Types="Solution Parameters") -> (Config File Ref Out=w19, Error Out=w18)
        }
        frame "Screen Printing" {
          call "Save Config Parser.gvi"(Full Layer Information In=w5, Config File In=w16, Error In=w17, Config Types="General Parameters") -> (Full Layer Information Out=w38, Config File Ref Out=w39, Error Out=w40)
          call "Save Config Parser.gvi"(Full Layer Information In=w38, Config File In=w39, Error In=w40, Config Types="Solution Parameters") -> (Config File Ref Out=w19, Error Out=w18)
        }
        frame "Thermal Evaporation" {
          call "Save Config Parser.gvi"(Full Layer Information In=w5, Config File In=w16, Error In=w17, Config Types="Thermal Evaporation Parameters") -> (Config File Ref Out=w19, Error Out=w18)
        }
        frame "E-beam Evaporation" {
          call "Save Config Parser.gvi"(Full Layer Information In=w5, Config File In=w16, Error In=w17, Config Types="General Parameters") -> (Config File Ref Out=w19, Error Out=w18)
        }
        frame "Electroplating" {
          call "Save Config Parser.gvi"(Full Layer Information In=w5, Config File In=w16, Error In=w17, Config Types="General Parameters") -> (Config File Ref Out=w19, Error Out=w18)
        }
        frame "Molecular Beam Epitaxy" {
          call "Save Config Parser.gvi"(Full Layer Information In=w5, Config File In=w16, Error In=w17, Config Types="General Parameters") -> (Config File Ref Out=w19, Error Out=w18)
        }
        frame "Pulsed Laser Deposition" {
          call "Save Config Parser.gvi"(Full Layer Information In=w5, Config File In=w16, Error In=w17, Config Types="General Parameters") -> (Config File Ref Out=w19, Error Out=w18)
        }
        frame "Chemical Vapour Deposition" {
          call "Save Config Parser.gvi"(Full Layer Information In=w5, Config File In=w16, Error In=w17, Config Types="General Parameters") -> (Config File Ref Out=w19, Error Out=w18)
        }
        frame "Atomic Layer Deposition" {
          call "Save Config Parser.gvi"(Full Layer Information In=w5, Config File In=w16, Error In=w17, Config Types="General Parameters") -> (Config File Ref Out=w19, Error Out=w18)
        }
        frame "Sputtering" {
          call "Save Config Parser.gvi"(Full Layer Information In=w5, Config File In=w16, Error In=w17, Config Types="General Parameters") -> (Config File Ref Out=w19, Error Out=w18)
        }
      }
      call "Close Config Data.gvi"(reference=w19, error in=w18) -> (error out=w41)
      call "General Simple Prompt.gvi"(Prompt Message="Your layer has been successfully saved!", Okay Button Message="Yay :D", Error In=w41, Prompt?=$"Prompt?") -> (Error Out=w1)
    }
  }
  $"Error Out" <- w1
