vi "Multi File Handler.gvi"   [LabVIEW NXG 5.0.0]
inputs:
  "Error In": error
  "JV Measurements Mega Cluster In": "JV Measurements Mega Cluster.gtype"
  "Author Default Layers Path": path
  "File Operation": "Configuration File Operation.gtype" = "Save Configuration File"
outputs:
  "Error Out": error
  "JV Measurements Mega Cluster Out": "JV Measurements Mega Cluster.gtype"
types:
  "Configuration File Operation.gtype" = enum{"Save Configuration File", "Load Configuration File"}
  "Cell Selector.gtype" = enum{"L.01", "L.02", "L.03", "L.04", "L.05", "L.06", "L.07", "L.08", "L.09", "L.10", "L.11", "L.12", "R.01", "R.02", "R.03", "R.04", "R.05", "R.06", "R.07", "R.08", "R.09", "R.10", "R.11", "R.12", "Custom"}
  "JV Data Cluster.gtype" = cluster{"Voltage (V)": f64[], "Current (A)": f64[], "Current Density (A/m^2)": f64[], "Cell Area (m^2)": f64, "Illumination (W/m^2)": f64, "Voc (V)": f64, "Jsc (A/m^2)": f64, "FF (%)": f64, "Rsh (Ω · m^2)": f64, "Rs (Ω · m^2)": f64, "Eff (%)": f64, "Measured Cell": "Cell Selector.gtype", "No Multiplexer": bool}
  "JV Scan Mode.gtype" = enum{"Rough", "Normal", "Accurate", "Smart", "Custom"}
  "JV Curve Parameters.gtype" = cluster{"JV Scan Mode": "JV Scan Mode.gtype", "Measurement Precision": "Accuracy Parameters.gtype", "Cell Parameters": "Cell Parameters.gtype"}
  "Deposition Method.gtype" = enum{"Blade Coating", "Spin Coating", "Thermal Evaporation", "E-beam Evaporation", "Sputtering", "Drop Casting", "Dip Coating", "Pulsed Laser Deposition", "Chemical Vapour Deposition", "Atomic Layer Deposition", "Spray Coating", "Screen Printing", "Electroplating", "Molecular Beam Epitaxy", "Custom Deposition"}
  "Layer Type.gtype" = enum{"Front Electrode", "Electrode Transport Layer", "Active Layer", "Hole Transport Layer", "Back Electrode", "Annealing Treatment", "Encapsulation", "Custom Layer"}
  "Full Layer Information.gtype" = cluster{"Blade Coating Parameters": "Blade Coating Parameters.gtype", "Deposition Method": "Deposition Method.gtype", "Layer Type": "Layer Type.gtype", "Spin Coating Parameters": "Spin Coating Parameters.gtype", "Thermal Evaporation Parameters": "Thermal Evaporation Parameters.gtype", "Solution Information": "Solution Information.gtype", "General Parameters": "General Parameters.gtype", "Current Deposition Method Information Cluster": "Useless Cluster.gtype", "Layer String ID": string}
  "JV Measurements Mega Cluster.gtype" = cluster{"Cell Array": "Cell Selector.gtype"[], "JV Full Data Array": "JV Data Cluster.gtype"[], "Cell Selector": "Cell Selector.gtype", "JV Curve Parameters": "JV Curve Parameters.gtype", "Full Layer Information Array": "Full Layer Information.gtype"[]}
uses:
  Pika IV Characterization NXG::Side Functions::Path Manipulation::Erase All Files in Folder.gvi
  Pika IV Characterization NXG::Side Functions::Path Manipulation::Erase Forbidden Chars.gvi
  Pika IV Characterization NXG::Main Functions::Layer Composition::File Management::Low Level::Single File Save.gvi
  Pika IV Characterization NXG::Main Functions::Layer Composition::File Management::Low Level::Single File Load.gvi
diagram:
  # This subVI Saves or loads all the default layer configuration files, checking if they exist first
  case ($"Error In") {
    frame Error, Default {
      w1 = $"Error In"
      w2 = $"JV Measurements Mega Cluster In"
    }
    frame No Error {
      case ($"File Operation") {
        frame "Save Configuration File", Default {
          Property Node(instance in=$"JV Measurements Mega Cluster In") -> ("Full Layer Information Array"=w3, instance out=w2)
          call "Erase All Files in Folder.gvi"(Folder With Files To Erase=$"Author Default Layers Path", Error In=$"Error In") -> (Error Out=w4)
          s1 = w4  # shift register
          for {
            w5 = each element of w3
            Property Node(instance in=w5) -> ("Layer String ID"=w6, instance out=w7)
            call "Erase Forbidden Chars.gvi"(Filename=w6, Replace option="_", Error In=s1) -> (Clean Filename=w8, Error Out=w9)
            Build Path(base path=$"Author Default Layers Path", name or relative path=w8) -> (appended path=w10)
            call "Single File Save.gvi"(Full Layer Information In=w7, Layer Type Data Path=w10, Error In=w9) -> (Error Out=w11)
            next s1 = w11
          }
          w1 = s1
        }
        frame "Load Configuration File" {
          List Folder(error in=$"Error In", path=$"Author Default Layers Path") -> (error out=w12, file names=w13, path out=w14)
          Is Empty Array(array=w13) -> w15
          case (w15) {
            frame True {
              w16 = "I found no default layers, please save some combination of layers as your default before trying to load them.\nMake sure you have selected the right author, since loading is author dependant!"
              One Button Dialog(button name ("OK")="Okay I will", message=w16)
              w1 = w12
              w2 = $"JV Measurements Mega Cluster In"
            }
            frame False {
              s2 = w12  # shift register
              for (iteration -> i1) {
                w17 = each element of w13
                Number To Decimal String(number=i1) -> (decimal integer string=w19)
                Concatenate Strings(w19, " ", w17) -> w20
                Build Path(base path=w14, name or relative path=w20) -> (appended path=w21)
                call "Single File Load.gvi"(Full Layer Information In="Full Layer Information.gtype" {all zero or empty}, Layer Type Data Path=w21, Error In=s2) -> (Full Layer Information Out=w22, Error Out=w23)
                append w22 to w18
                next s2 = w23
              }
              Property Node(instance in=$"JV Measurements Mega Cluster In", "Full Layer Information Array"=w18) -> (instance out=w2)
              w1 = s2
            }
          }
        }
      }
    }
  }
  $"JV Measurements Mega Cluster Out" <- w2
  $"Error Out" <- w1
