vi "New Layer Prompt.gvi"   [LabVIEW NXG 5.0.0]
inputs:
  "Error In": error
  "Misc Data Mega Cluster In": "Misc Mega Cluster.gtype"
outputs:
  "Error Out": error
  "Misc Mega Cluster Data Out": "Misc Mega Cluster.gtype"
  "Cancelled?": bool
panel controls:
  "Layer Type": "Layer Type.gtype" = "Front Electrode"
  "Deposition Method": "Deposition Method.gtype" = "Blade Coating"
  "Blade Coating Parameters": "Blade Coating Parameters.gtype"
  "Solution Information": "Solution Information.gtype"
  "Spin Coating Parameters": "Spin Coating Parameters.gtype"
  "Thermal Evaporation Parameters": "Thermal Evaporation Parameters.gtype"
  "General Parameters": "General Parameters.gtype"
  "Add Layer Button": bool
  "New Layer Prompt Ref Cluster In": "New Layer Prompt Ref Cluster.gtype"
  "Save Layer File": bool
  "Load Layer File": bool
  "Cancel Button": bool
  "Reset Layer Button": bool
  "JV Measurements Mega Cluster In": "JV Measurements Mega Cluster.gtype"
types:
  "Layer Type.gtype" = enum{"Front Electrode", "Electrode Transport Layer", "Active Layer", "Hole Transport Layer", "Back Electrode", "Annealing Treatment", "Encapsulation", "Custom Layer"}
  "Deposition Method.gtype" = enum{"Blade Coating", "Spin Coating", "Thermal Evaporation", "E-beam Evaporation", "Sputtering", "Drop Casting", "Dip Coating", "Pulsed Laser Deposition", "Chemical Vapour Deposition", "Atomic Layer Deposition", "Spray Coating", "Screen Printing", "Electroplating", "Molecular Beam Epitaxy", "Custom Deposition"}
  "Blade Coating Parameters.gtype" = cluster{"Thickness (nm)": f64, "Blade Initial Speed (mm/s)": f64, "Speed Gradient": bool, "Blade Final Speed (mm/s)": f64, "Blade Gap (um)": f64, "Blade Temperature (ºC)": f64, "Droplet Volume (ul)": f64, "Subsequent layers": f64, "Glovebox": bool, "Comments": string}
  "Solution Information.gtype" = cluster{"Concentration (mg/ml)": f64, "Stirring Time (kr)": f64, "Glovebox": bool, "Composition Array": cluster{"Material": string, "Ratio": f64}[], "Solvent Array": cluster{"Solvent": string, "Ratio": f64}[], "Solution Preparation Date": f64, "Comments": string}
  "Spin Coating Parameters.gtype" = cluster{"Thickness (nm)": f64, "Spin Speed (rpm)": f64, "Dynamic Deposition": bool, "Spin Acceleration (rpm/s)": f64, "Droplet Volume (ul)": f64, "Subsequent layers": f64, "Glovebox": bool, "Comments": string}
  "Thermal Evaporation Parameters.gtype" = cluster{"Thickness (nm)": f64, "Deposition Rate (nm/s)": f64, "Comments": string, "Sample Rotation": bool, "Material": string}
  "General Parameters.gtype" = cluster{"Thickness (nm)": f64, "Comments": string, "Material": string}
  T1 = cluster{"State Ref": "StringControl reference", "Substate Ref": "StringControl reference", "Current State Ref": "EnumSelector reference", "Main Tab Ref": "TabControl reference", "Plot Now Flag Ref": "BooleanControl reference"}
  T2 = cluster{"Default Data Saving Location Ref": "PathSelector reference"}
  T3 = cluster{"Author Initials Ref": "ComboBoxSelector reference", "Batch Name Ref": "StringControl reference", "Cell Number Ref": "StringControl reference", "Current Date Ref": "StringControl reference", "Sample Comments Ref": "StringControl reference", "Sample Prefix Ref": "StringControl reference", "Custom Date Ref": "CheckBox reference", "Label Info Error Label Ref": "StringControl reference", "Label Info Missing Error Ref": "BooleanControl reference"}
  T4 = cluster{"Cell Parameters Ref": "Cluster reference", "Cell Selector Ref": "Cluster reference", "Measurement Precision Ref": "Cluster reference", "JV Scan Mode Ref": "EnumSelector reference"}
  T5 = cluster{"Progress % Ref": "ProgressBar reference", "Progress Counter Ref": "NumericTextBoxDouble reference", "Live JV Parameters Ref": "Cluster reference"}
  T6 = cluster{"Layer Information Ref": "ArrayViewer reference"[]}
  T7 = cluster{"Cell Selector Block Ref": "Rectangle reference", "Smart Mode Block Ref": "Rectangle reference", "dV Block Ref": "Rectangle reference", "Smart Mode Text Ref": "Text reference", "No Multiplexer Detected Text Ref": "Text reference"}
  T8 = cluster{"JV Measurements Mega Cluster Ref": "Cluster reference", "Instrument Control Mega Cluster Ref": "Cluster reference"}
  T9 = cluster{"JV Main Graph Ref": "Graph reference", "Voc Graph Ref ": "Graph reference", "Jsc Graph Ref": "Graph reference", "Efficiency Graph Ref": "Graph reference", "Fill Factor Graph Ref": "Graph reference", "Series Resistance Graph Ref": "Graph reference", "Shunt Resistance Graph Ref": "Graph reference"}
  "Full Reference Cluster.gtype" = cluster{"Status Report": T1, "Path Cluster": T2, "Sample Naming Cluster": T3, "Acquisition Parameters": T4, "Live Progress Cluster": T5, "Sample Extra Information": T6, "Visual Elements": T7, "Mega Cluster References": T8, "Plotting": T9, "System Parameters": cluster{"Main VI Ref": VIRefnum}}
  "Full Layer Information.gtype" = cluster{"Blade Coating Parameters": "Blade Coating Parameters.gtype", "Deposition Method": "Deposition Method.gtype", "Layer Type": "Layer Type.gtype", "Spin Coating Parameters": "Spin Coating Parameters.gtype", "Thermal Evaporation Parameters": "Thermal Evaporation Parameters.gtype", "Solution Information": "Solution Information.gtype", "General Parameters": "General Parameters.gtype", "Current Deposition Method Information Cluster": "Useless Cluster.gtype", "Layer String ID": string}
  "Misc Mega Cluster.gtype" = cluster{"Full Reference Cluster": "Full Reference Cluster.gtype", "Full Layer Information Array": "Full Layer Information.gtype"[]}
  "New Layer Prompt Ref Cluster.gtype" = cluster{"Add Layer Button Ref": "BooleanControl reference", "This VI Ref": VIRefnum, "Blade Coating Parameters Ref": "Cluster reference", "Deposition Method Ref": "EnumSelector reference", "General Parameters Ref": "Cluster reference", "Layer Type ref": "EnumSelector reference", "Solution Information Ref": "Cluster reference", "Spin Coating Parameters Ref": "Cluster reference", "Thermal Evaporation Parameters Ref": "Cluster reference", "Load Layer File Ref": "BooleanControl reference", "Save Layer File Ref": "BooleanControl reference"}
  "Cell Selector.gtype" = enum{"L.01", "L.02", "L.03", "L.04", "L.05", "L.06", "L.07", "L.08", "L.09", "L.10", "L.11", "L.12", "R.01", "R.02", "R.03", "R.04", "R.05", "R.06", "R.07", "R.08", "R.09", "R.10", "R.11", "R.12", "Custom"}
  "JV Data Cluster.gtype" = cluster{"Voltage (V)": f64[], "Current (A)": f64[], "Current Density (A/m^2)": f64[], "Cell Area (m^2)": f64, "Illumination (W/m^2)": f64, "Voc (V)": f64, "Jsc (A/m^2)": f64, "FF (%)": f64, "Rsh (Ω · m^2)": f64, "Rs (Ω · m^2)": f64, "Eff (%)": f64, "Measured Cell": "Cell Selector.gtype", "No Multiplexer": bool}
  "JV Scan Mode.gtype" = enum{"Rough", "Normal", "Accurate", "Smart", "Custom"}
  "JV Curve Parameters.gtype" = cluster{"JV Scan Mode": "JV Scan Mode.gtype", "Measurement Precision": "Accuracy Parameters.gtype", "Cell Parameters": "Cell Parameters.gtype"}
  "JV Measurements Mega Cluster.gtype" = cluster{"Cell Array": "Cell Selector.gtype"[], "JV Full Data Array": "JV Data Cluster.gtype"[], "Cell Selector": "Cell Selector.gtype", "JV Curve Parameters": "JV Curve Parameters.gtype"}
uses:
  Pika IV Characterization NXG::Main Functions::Layer Composition::Controls and Data Clusters::New Layer Reference Setting.gvi
  Pika IV Characterization NXG::Main Functions::Layer Composition::Check and Set Control Visibility.gvi
  Pika IV Characterization NXG::Main Functions::Layer Composition::Data Management::Layer Information Cluster Subroutine.gvi
  Pika IV Characterization NXG::Main Functions::Layer Composition::Data Management::Missing info::Missing Information Check.gvi
  Pika IV Characterization NXG::Main Functions::Layer Composition::Data Management::Update Misc Mega Cluster.gvi
  Pika IV Characterization NXG::Main Functions::Layer Composition::File Management::Default Configuration Handler.gvi
  Pika IV Characterization NXG::Main Functions::Layer Composition::Data Management::Reset Layer Info Subroutine.gvi
diagram:
  case ($"Error In") {
    frame Error, Default {
      w1 = $"Error In"
      w2 = $"Misc Data Mega Cluster In"
      w3 = default
    }
    frame No Error {
      This VI Reference() -> (reference out=w4)
      Property Node(instance in=w4, error in=$"Error In") -> ("Panel"=w5, error out=w6)
      Property Node(instance in=w5, error in=w6) -> ("Window"=w7, error out=w8)
      Open Window(reference in=w7, error in=w8) -> (reference out=w9, error out=w10)
      Property Node(instance in=reference to "Deposition Method", "ValueSignaling"="Blade Coating", error in=w10) -> (error out=w11)
      case (TRUE) {
        frame False, Default {
          w12 = default
          w13 = w11
        }
        frame True {
          This VI Reference() -> (reference out=w14)
          call "New Layer Reference Setting.gvi"(Error In=w11, This VI Ref=w14, Add Layer Button Ref=reference to "Add Layer Button", Blade Coating ParametersRef=reference to "Blade Coating Parameters", Deposition Method Ref=reference to "Deposition Method", General ParametersRef=reference to "General Parameters", Layer Type ref=reference to "Layer Type", Solution Information Ref=reference to "Solution Information", Spin Coating ParametersRef=reference to "Spin Coating Parameters", Thermal Evaporation ParametersRef=reference to "Thermal Evaporation Parameters", Load Layer File Ref=reference to "Load Layer File", Save Layer File Ref=reference to "Save Layer File", New Layer Prompt Ref Cluster In=$"New Layer Prompt Ref Cluster In") -> (Error Out=w13, New Layer Prompt Ref Cluster Out=w12)
        }
      }
      s1 = w13  # shift register
      s2 = w12  # shift register
      s3 = $"Misc Data Mega Cluster In"  # shift register
      s4 = "Full Layer Information.gtype" {all zero or empty}  # shift register
      while {
        event (timeout = 50) {
          on "Timeout" {
            w15 = s1
            w16 = s2
            w17 = default
            w18 = s3
            w19 = s4
            w3 = default
          }
          on "Deposition Method" Value changed {
            call "Check and Set Control Visibility.gvi"(New Layer Prompt Ref Cluster In=s2, Error In=s1) -> (New Layer Prompt Ref Cluster Out=w16, Error Out=w15)
            w17 = default
            w18 = s3
            w19 = default
            w3 = default
          }
          on "Add Layer Button" Value changed {
            call "Layer Information Cluster Subroutine.gvi"(New Layer Prompt Ref Cluster In=s2, Full Layer Information In=s4, Error In=s1, Layer Information Operation="Update Cluster") -> (New Layer Prompt Ref Cluster Out=w20, Full Layer Information Out=w21, Error Out=w22)
            call "Missing Information Check.gvi"(New Layer Prompt Ref Cluster In=w20, Full Layer Information In=w21, Error In=w22) -> (New Layer Prompt Ref Cluster Out=w23, Full Layer Information Out=w24, Proceed?=w17, Error Out=w25)
            call "Layer Information Cluster Subroutine.gvi"(New Layer Prompt Ref Cluster In=w23, Full Layer Information In=w24, Error In=w25, Layer Information Operation="Update Controls") -> (New Layer Prompt Ref Cluster Out=w16, Full Layer Information Out=w26, Error Out=w27)
            call "Update Misc Mega Cluster.gvi"(Misc Data Mega Cluster In=s3, Full Layer Information In=w26, Proceed?=w17, Error In=w27) -> (Misc Data Mega Cluster Out=w18, Full Layer Information Out=w19, Error Out=w15)
            w3 = default
          }
          on "Save Layer File" Value changed {
            call "Layer Information Cluster Subroutine.gvi"(New Layer Prompt Ref Cluster In=s2, Full Layer Information In=s4, Error In=s1, Layer Information Operation="Update Cluster") -> (New Layer Prompt Ref Cluster Out=w28, Full Layer Information Out=w29, Error Out=w30)
            call "Missing Information Check.gvi"(New Layer Prompt Ref Cluster In=w28, Full Layer Information In=w29, Error In=w30) -> (New Layer Prompt Ref Cluster Out=w16, Full Layer Information Out=w31, Proceed?=w32, Error Out=w33)
            call "Default Configuration Handler.gvi"(Misc Data Mega Cluster In=s3, Full Layer Information In=w31, Proceed?=w32, Error In=w33, Configuration File Operation="Save Configuration File") -> (Misc Data Mega Cluster Out=w18, Error Out=w15)
            w17 = default
            w19 = default
            w3 = default
          }
          on "Cancel Button" Value changed {
            w15 = s1
            w16 = s2
            w17 = TRUE
            w18 = s3
            w19 = s4
            w3 = TRUE
          }
          on "Load Layer File" Value changed {
            call "Default Configuration Handler.gvi"(Misc Data Mega Cluster In=s3, Full Layer Information In=s4, Proceed?=TRUE, Error In=s1, Configuration File Operation="Load Configuration File") -> (Misc Data Mega Cluster Out=w18, Full Layer Information Out=w34, Error Out=w35)
            call "Layer Information Cluster Subroutine.gvi"(New Layer Prompt Ref Cluster In=s2, Full Layer Information In=w34, Error In=w35, Layer Information Operation="Update Controls") -> (New Layer Prompt Ref Cluster Out=w16, Full Layer Information Out=w19, Error Out=w15)
            w17 = default
            w3 = default
          }
          on "Reset Layer Button" Value changed {
            call "Reset Layer Info Subroutine.gvi"(Full Layer Information In=s4, Error In=s1) -> (Full Layer Information Out=w36, Error Out=w37)
            call "Layer Information Cluster Subroutine.gvi"(New Layer Prompt Ref Cluster In=s2, Full Layer Information In=w36, Error In=w37, Layer Information Operation="Update Controls") -> (New Layer Prompt Ref Cluster Out=w16, Full Layer Information Out=w19, Error Out=w15)
            w17 = default
            w18 = s3
            w3 = default
          }
        }
        Logical Or(w15, w17) -> w38
        next s1 = w15
        next s2 = w16
        next s3 = w18
        next s4 = w19
        stop if w38
      }
      Close Window(reference in=w9, error in=s1) -> (error out=w1)
      w2 = s3
    }
  }
  $"Cancelled?" <- w3
  $"Misc Mega Cluster Data Out" <- w2
  $"Error Out" <- w1
