vi "Update Cell Selector.gvi"   [LabVIEW NXG 5.0.0]
inputs:
  "Error In": error
  "Misc Data Mega Cluster In": "Misc Mega Cluster.gtype"
outputs:
  "Error Out": error
  "Misc Data Mega Cluster Out": "Misc Mega Cluster.gtype"
types:
  T1 = cluster{"State Ref": "StringControl reference", "Substate Ref": "StringControl reference", "Current State Ref": "EnumSelector reference", "Main Tab Ref": "TabControl reference"}
  T2 = cluster{"Default Data Saving Location Ref": "PathSelector reference"}
  T3 = cluster{"Author Initials Ref": "ComboBoxSelector reference", "Batch Name Ref": "StringControl reference", "Cell Number Ref": "StringControl reference", "Current Date Ref": "StringControl reference", "Sample Comments Ref": "StringControl reference", "Sample Prefix Ref": "StringControl reference", "Custom Date Ref": "CheckBox reference", "Label Info Error Label Ref": "StringControl reference", "Label Info Missing Error Ref": "BooleanControl reference"}
  T4 = cluster{"Cell Parameters Ref": "Cluster reference", "Cell Selector Ref": "Cluster reference", "Measurement Precision Ref": "Cluster reference", "JV Scan Mode Ref": "EnumSelector reference"}
  T5 = cluster{"Live JV Parameters Ref": "Cluster reference", "Progress % Ref": "ProgressBar reference", "Progress Counter Ref": "NumericTextBoxDouble reference"}
  T6 = cluster{"Layer Information Ref": "ArrayViewer reference"[]}
  T7 = cluster{"Cell Selector Block Ref": "Rectangle reference"}
  "Full Reference Cluster.gtype" = cluster{"Status Report": T1, "Path Cluster": T2, "Sample Naming Cluster": T3, "Acquisition Parameters": T4, "Live Progress Cluster": T5, "Sample Extra Information": T6, "Visual Elements": T7}
  "Misc Mega Cluster.gtype" = cluster{"Full Reference Cluster": "Full Reference Cluster.gtype"}
  T8 = cluster{"L.01": bool, "R.01": bool, "L.02": bool, "R.02": bool, "L.03": bool, "R.03": bool, "L.04": bool, "R.04": bool, "L.05": bool, "R.05": bool, "L.06": bool, "R.06": bool, "L.07": bool, "R.07": bool, "L.08": bool, "R.08": bool, "L.09": bool, "R.09": bool, "L.10": bool, "R.10": bool, "L.11": bool, "R.11": bool, "L.12": bool, "R.12": bool}
diagram:
  # This SubVI Takes care of the control of the MRM Cell Selector update process. It reads the multiple states and sets the controls
  # accordingly to ease the selection of the cells.
  case ($"Error In") {
    frame Error, Default {
      w1 = $"Error In"
      w2 = $"Misc Data Mega Cluster In"
    }
    frame No Error {
      Property Node(instance in=$"Misc Data Mega Cluster In") -> ("Full Reference Cluster:Acquisition Parameters:Cell Selector Ref"=w3, "Full Reference Cluster:Visual Elements:Cell Selector Block Ref"=w4, instance out=w2)
      Property Node(instance in=w3, error in=$"Error In") -> ("Value"=w5, error out=w6, instance out=w7)
      Property Node(instance in=w5) -> ("All"=w8, "Left"=w9, "Right"=w10, "Cell Cluster"=w11, "Reset"=w12, "No Multiplexer"=w13, instance out=w14)
      Property Node(instance in=w4, "Visible"=w13, error in=w6) -> (error out=w15)
      case (w12) {
        frame True {
          Property Node(instance in=w14, "All"=FALSE, "Left"=FALSE, "Right"=FALSE, "Cell Cluster"=T8 {all zero or empty}, "Reset"=FALSE) -> (instance out=w16)
        }
        frame False {
          case (w8) {
            frame False, Default {
              case (w10) {
                frame False, Default {
                  w18 = w11
                }
                frame True {
                  Property Node(instance in=w11, "R.01"=TRUE, "R.02"=TRUE, "R.03"=TRUE, "R.04"=TRUE, "R.05"=TRUE, "R.06"=TRUE, "R.07"=TRUE, "R.08"=TRUE, "R.09"=TRUE, "R.10"=TRUE, "R.11"=TRUE, "R.12"=TRUE) -> (instance out=w18)
                }
              }
              case (w9) {
                frame False, Default {
                  w17 = w18
                }
                frame True {
                  Property Node(instance in=w18, "L.01"=TRUE, "L.02"=TRUE, "L.03"=TRUE, "L.04"=TRUE, "L.05"=TRUE, "L.06"=TRUE, "L.07"=TRUE, "L.08"=TRUE, "L.09"=TRUE, "L.10"=TRUE, "L.11"=TRUE, "L.12"=TRUE) -> (instance out=w17)
                }
              }
            }
            frame True {
              Property Node(instance in=w11, "R.05"=TRUE, "L.06"=TRUE, "R.06"=TRUE, "L.07"=TRUE, "R.07"=TRUE, "L.08"=TRUE, "R.08"=TRUE, "L.09"=TRUE, "R.09"=TRUE, "L.10"=TRUE, "R.10"=TRUE, "L.11"=TRUE, "R.11"=TRUE, "L.12"=TRUE, "R.12"=TRUE) -> (instance out=w19)
              Property Node(instance in=w19, "L.01"=TRUE, "R.01"=TRUE, "L.02"=TRUE, "R.02"=TRUE, "L.03"=TRUE, "R.03"=TRUE, "L.04"=TRUE, "R.04"=TRUE, "L.05"=TRUE) -> (instance out=w17)
            }
          }
          Property Node(instance in=w14, "Cell Cluster"=w17) -> (instance out=w16)
        }
      }
      Property Node(instance in=w7, "Value"=w16, error in=w15) -> (error out=w1)
    }
  }
  $"Misc Data Mega Cluster Out" <- w2
  $"Error Out" <- w1
