vi "K2450 Set Constant Parameters.gvi"   [LabVIEW NXG 5.0.0]
inputs:
  "Error In": error
  "Instrument Control Mega Cluster In": "Instrument Control Mega Cluster.gtype"
  "IV Measurements Mega Cluster In": "IV Measurements Mega Cluster.gtype"
outputs:
  "Error Out": error
  "Instrument Control Mega Cluster Out": "Instrument Control Mega Cluster.gtype"
  "IV Measurements Mega Cluster Out": "IV Measurements Mega Cluster.gtype"
types:
  T1 = cluster{"Element 1": "VISA Instr", "Element 2": string}
  T2 = enum{"Keithley 2400 Series", "Keithley 2450 Series"}
  "Instrument Control.gtype" = cluster{"Multiplexer Arduino Detected?": bool, "Multiplexer Arduino Address": "VISA Instr", "Arduinos List": T1[], "Multiplexer Log": string, "Keythley Address": "VISA Instr", "Keithley Detected?": bool, "Keithley ID": string, "Detected Keithley Type": T2}
  "Debugging Cluster.gtype" = cluster{"Debugging mode?": bool, "Initialize App": bool, "Insturment Debugging": cluster{"Keithley": bool, "Arduino": bool}}
  "Instrument Control Mega Cluster.gtype" = cluster{"Instrument Control": "Instrument Control.gtype", "Debugging Cluster": "Debugging Cluster.gtype"}
  "IV Mode.gtype" = enum{"Rough", "Normal", "Accurate", "Smart", "Custom"}
  "IV Curve Parameters.gtype" = cluster{"Cell Parameters": "Cell Parameters.gtype", "Measurement Precision": "Accuracy Parameters.gtype", "IV Accuracy Mode": "IV Mode.gtype"}
  T3 = cluster{"L.01": bool, "R.01": bool, "L.02": bool, "R.02": bool, "L.03": bool, "R.03": bool, "L.04": bool, "R.04": bool, "L.05": bool, "R.05": bool, "L.06": bool, "R.06": bool, "L.07": bool, "R.07": bool, "L.08": bool, "R.08": bool, "L.09": bool, "R.09": bool, "L.10": bool, "R.10": bool, "L.11": bool, "R.11": bool, "L.12": bool, "R.12": bool}
  "Cell Selector.gtype" = cluster{"All": bool, "Left": bool, "Right": bool, "Cell Cluster": T3, "Reset": bool, "Random Order ": bool, "Continuous Cell": bool}
  "IV Measurements Mega Cluster.gtype" = cluster{"IV Curve Parameters": "IV Curve Parameters.gtype", "Cell Selector": "Cell Selector.gtype"}
uses:
  Pika IV Characterization NXG::Main Functions::Instruction Handling::FGV Current State.gvi
  Pika IV Characterization NXG::Side Functions::Instrument Control::Keithley::Keithley Sweep Parameter Calculator.gvi
  Labview_NXG_Keithley_SMU_2450_2460_2461::Configure::Configure Measurement Range.gvi
  Labview_NXG_Keithley_SMU_2450_2460_2461::Configure::Configure Output.gvi
  Labview_NXG_Keithley_SMU_2450_2460_2461::Configure::Configure Source Function.gvi
  Labview_NXG_Keithley_SMU_2450_2460_2461::Configure::Configure Measurement Function.gvi
  Labview_NXG_Keithley_SMU_2450_2460_2461::Configure::Configure Integration Filter.gvi
  Labview_NXG_Keithley_SMU_2450_2460_2461::Configure::Configure Linear Mode Sweep.gvi
diagram:
  # This SubVI Sets all the constant parameters for the keithley and if we are in "smart" mode, it prevents the keithley from sweeping since
  # this mode performs uneven IV curves that are not compatible with the sweep functionality
  case ($"Error In") {
    frame Error, Default {
      w1 = $"Error In"
      w2 = $"Instrument Control Mega Cluster In"
      w3 = $"IV Measurements Mega Cluster In"
    }
    frame No Error {
      Property Node(instance in=$"Instrument Control Mega Cluster In") -> ("Instrument Control:Keythley Address"=w4, instance out=w5)
      call "FGV Current State.gvi"(Current State Instructions="Set Current Substate", Current Substate="Setting Keithley Parameters", Error In=$"Error In") -> (Error Out=w6)
      call "Keithley Sweep Parameter Calculator.gvi"(IV Measurements Mega Cluster In=$"IV Measurements Mega Cluster In", Error In=w6) -> (IV Measurements Mega Cluster Out=w7, Measurement Speed (1 PLC)=w8, Manual Range (1.0)=w9, Sweep Points=w10, Error Out=w11, Enable Auto Range (T:Enable)=w12)
      call "Configure Measurement Range.gvi"(VISA resource name=w4, Function (0: Volts)="Volts"(0), Enable Auto Range (T:Enable)=TRUE, error in (no error)=w11) -> (VISA resource name out=w13, error out=w14)
      call "Configure Measurement Range.gvi"(Manual Range (1.0)=w9, VISA resource name=w13, Function (0: Volts)="Current"(1), Enable Auto Range (T:Enable)=w12, error in (no error)=w14) -> (VISA resource name out=w15, error out=w16)
      call "Configure Output.gvi"(VISA resource name=w15, Source Mode (0: Voltage)="Voltage"(0), error in (no error)=w16) -> (VISA resource name out=w17, error out=w18)
      call "Configure Source Function.gvi"(VISA resource name=w17, Function (0: Volts)="Volts"(0), error in (no error)=w18) -> (VISA resource name out=w19, error out=w20)
      call "Configure Measurement Function.gvi"(VISA resource name=w19, Function (0: Volts)="Current"(1), error in (no error)=w20) -> (VISA resource name out=w21, error out=w22)
      call "Configure Integration Filter.gvi"(VISA resource name=w21, Function (0: Volts)="Current"(1), Measurement Speed (1 PLC)=w8, error in (no error)=w22) -> (VISA resource name out=w23, error out=w24)
      Property Node(instance in=w7) -> ("IV Curve Parameters:IV Accuracy Mode"=w25, instance out=w3)
      Is Not Equal(x="Smart", y=w25) -> w26
      case (w26) {
        frame False, Default {
          w27 = w23
          w1 = w24
        }
        frame True {
          call "Configure Linear Mode Sweep.gvi"(VISA resource name=w23, Source Mode (0: Voltage)="Voltage"(0), Sweep Points=w10, Delay (0)=0, error in (no error)=w24) -> (VISA resource name out=w27, error out=w1)
        }
      }
      Property Node(instance in=w5, "Instrument Control:Keythley Address"=w27) -> (instance out=w2)
    }
  }
  $"IV Measurements Mega Cluster Out" <- w3
  $"Instrument Control Mega Cluster Out" <- w2
  $"Error Out" <- w1
