vi "Keithley Sweep Parameter Calculator.gvi"   [LabVIEW NXG 5.0.0]
inputs:
  "Error In": error
  "IV Measurements Mega Cluster In": "IV Measurements Mega Cluster.gtype"
outputs:
  "Error Out": error
  "Enable Auto Range (T:Enable)": bool
  "IV Measurements Mega Cluster Out": "IV Measurements Mega Cluster.gtype"
  "Measurement Speed (1 PLC)": f64
  "Manual Range (1.0)": f64
  "Sweep Points": T1
types:
  T1 = cluster{"Start ": f64, "Stop ": f64, "Number of Points (5)": u32}
  "IV Mode.gtype" = enum{"Rough", "Normal", "Accurate", "Smart", "Custom"}
  "IV Curve Parameters.gtype" = cluster{"Cell Parameters": "Cell Parameters.gtype", "Measurement Precision": "Accuracy Parameters.gtype", "IV Accuracy Mode": "IV Mode.gtype"}
  T2 = cluster{"L.01": bool, "R.01": bool, "L.02": bool, "R.02": bool, "L.03": bool, "R.03": bool, "L.04": bool, "R.04": bool, "L.05": bool, "R.05": bool, "L.06": bool, "R.06": bool, "L.07": bool, "R.07": bool, "L.08": bool, "R.08": bool, "L.09": bool, "R.09": bool, "L.10": bool, "R.10": bool, "L.11": bool, "R.11": bool, "L.12": bool, "R.12": bool}
  "Cell Selector.gtype" = cluster{"All": bool, "Left": bool, "Right": bool, "Cell Cluster": T2, "Reset": bool, "Random Order ": bool, "Continuous Cell": bool}
  "IV Measurements Mega Cluster.gtype" = cluster{"IV Curve Parameters": "IV Curve Parameters.gtype", "Cell Selector": "Cell Selector.gtype"}
uses:
  Pika IV Characterization NXG::Side Functions::Utilities::Calculations::Voltage Direction Calculator.gvi
  Pika IV Characterization NXG::Side Functions::Utilities::Calculations::Order of Magnitude Extractor.gvi
diagram:
  # This SubVI Calculates the number of sweep points required for the
  # specified SRM parameters. It also extracts all the parameters so that
  # they can be set correctly on the keithley.
  case ($"Error In") {
    frame Error, Default {
      w1 = default
      w2 = default
      w3 = $"Error In"
      w4 = $"IV Measurements Mega Cluster In"
      w5 = default
      w6 = default
    }
    frame No Error {
      Property Node(instance in=$"IV Measurements Mega Cluster In") -> ("IV Curve Parameters:Cell Parameters:Curr Range (A)"=w7, "IV Curve Parameters:Cell Parameters:Autorange"=w1, "IV Curve Parameters:Cell Parameters:Max (A)"=w8, "IV Curve Parameters:Measurement Precision:Integration Time"=w6, "IV Curve Parameters:Cell Parameters:Max (V)"=w9, "IV Curve Parameters:Cell Parameters:Min (V)"=w10, "IV Curve Parameters:Measurement Precision:V Points"=w11, "IV Curve Parameters:Cell Parameters:Sweep Dir"=w12, instance out=w4)
      In Range And Coerce(lower limit=1e-08, upper limit=1, x=w7) -> (coerced(x)=w13)
      Select(s=w1, t=w8, f=w13) -> w2
      call "Voltage Direction Calculator.gvi"(Max Voltage (V)=w9, Min Voltage (V)=w10, Error In=$"Error In", Sweep Direction=w12) -> (Start=w14, End=w15, Error Out=w16)
      call "Order of Magnitude Extractor.gvi"(Number to extract order of magnitude=w13, Error In=w16) -> (Error Out=w3)
      Property Node(instance in=T1 {"Start "=1, "Stop "=0, "Number of Points (5)"=5}, "Start "=w14, "Stop "=w15, "Number of Points (5)"=w11) -> (instance out=w5)
    }
  }
  $"Enable Auto Range (T:Enable)" <- w1
  $"Manual Range (1.0)" <- w2
  $"IV Measurements Mega Cluster Out" <- w4
  $"Error Out" <- w3
  $"Measurement Speed (1 PLC)" <- w6
  $"Sweep Points" <- w5
