vi "Name File Prompt Window.gvi"   [LabVIEW NXG 5.0.0]
inputs:
  "Exclusive focus?": bool
  "Error In": error
outputs:
  "Output": string
  "Error Out": error
panel controls:
  "Filename:": string
  "Okay button": bool
uses:
  Pika IV Characterization NXG::Side Functions::Path Manipulation::Erase Forbidden Chars.gvi
diagram:
  # This SubVI Takes a filename and prompts the user to chose a different one because the current one is already in use.
  # It also makes sure that the new filename does not contain forbidden characters and erases those from the name automatically.
  case ($"Error In") {
    frame Error, Default {
      w1 = $"Error In"
      w2 = default
    }
    frame No Error {
      # We first open the prompt window separately
      Property Node(instance in=reference to unnamed native front panel, error in=$"Error In") -> ("Window"=w3, error out=w4)
      Open Window(reference in=w3, error in=w4, modal=$"Exclusive focus?") -> (reference out=w5, error out=w6)
      Property Node(instance in=reference to "Filename:", "Value"="", error in=w6) -> (error out=w7)
      while {
        Wait Until Next Multiple(multiple to wait=50)
        call "Erase Forbidden Chars.gvi"(Filename=$"Filename:", Error In=w7) -> (Clean Filename=w8, Forbidden Chars?=w9, Error Out=w10)
        case (w9) {
          frame False, Default { }
          frame True {
            w11 = "Please refrain from using the\nfollowing Characters:\n\\  /  *  :  ?  \"  >  <  |  "
            One Button Dialog(button name ("OK")="Oh sorry, I did not Know they\ncould not be used", message=w11)
          }
        }
        Is Empty String Or Path(string/path=w8) -> w12
        Logical And($"Okay button", w12) -> w13
        # We prompt the user if the provided filenames are
        # not acceptable
        case (w13) {
          frame False, Default { }
          frame True {
            w14 = "Oh sorry, I thought an empty \nfilename was completely acceptable\nand not :O"
            w15 = "Renaming the file means you \nhave to change the name not \ncompletely erase it :')"
            One Button Dialog(button name ("OK")=w14, message=w15)
          }
        }
        Logical Or($"Okay button", w9) -> w16
        case (w16) {
          frame False, Default {
            w17 = w10
          }
          frame True {
            Property Node(instance in=reference to "Filename:", "Value"=w8, error in=w10) -> (error out=w17)
            Wait Until Next Multiple(multiple to wait=2000)
          }
        }
        stop if $"Okay button"
      }
      String Length(string=w8) -> (length=w18)
      Subtract(x=w18, y=4) -> w19
      Replace Substring(length (len. of substring)=4, offset=w19, string=w8) -> (replaced substring=w20)
      Is Not Equal(x=w20, y=".ini") -> w21
      case (w21) {
        frame False, Default {
          # If the filename does not contain extension
          # we add the extension automatically
          w2 = w8
        }
        frame True {
          Concatenate Strings(w8, ".ini") -> w2
        }
      }
      Close Window(reference in=w5, error in=w17) -> (error out=w1)
    }
  }
  $Output <- w2
  $"Error Out" <- w1
