vi "Path Already Exists prompt.gvi"   [LabVIEW NXG 5.0.0]
inputs:
  "Error In": error
  "Path to Check": path
outputs:
  "Error Out": error
  "Existing File Instruction out": "File Operation.gtype"
types:
  "File Operation.gtype" = enum{"Replace", "Rename", "Do not save"}
uses:
  Pika IV Characterization NXG::Side Functions::Messages And Prompts::FGV Repeat Operation for all following files.gvi
  NI::G Core::File IO (General)::Check if File or Folder Exists.gvi
diagram:
  # This SubVi checks if a file already exists and prompts the
  # user to decide between replacing renaming or not saving the file
  case ($"Error In") {
    frame Error, Default {
      w1 = $"Error In"
      w2 = default
    }
    frame No Error {
      call "FGV Repeat Operation for all following files.gvi"(FGV Instructions="Read State", Error In=$"Error In") -> (Prompt?=w3, File Operation=w4, Error Out=w5)
      case (w3) {
        frame False, Default {
          w2 = w4
          w6 = w5
        }
        frame True {
          call "Check if File or Folder Exists.gvi"(file or folder=$"Path to Check", error in=w5) -> (file or folder exists?=w7, error out=w8)
          case (w7) {
            frame False, Default {
              w6 = w8
              w9 = "left button"
            }
            frame True {
              w10 = "The file you're trying to save already exists, do you want to:"
              Three Button Dialog(Allow user to close window? (TRUE)=FALSE, Center Button Text ("No")="Rename the file \nso that they are both safe", Justify Message (Left)="center", Left Button Text ("Yes")="Replace the already\nexisting file!", Right Button Text ("Cancel")="Do not save the\ncurrent file", Window Title (" ")="Existing File", message=w10) -> (Which Button?=w9)
              w6 = w8
            }
          }
          case (w9) {
            frame "left button" {
              w2 = "Replace"
            }
            frame "center button", Default {
              w11 = "Rename"  # File Operation
              w2 = w11
            }
            frame "right button" {
              w12 = "Do not save"  # File Operation
              w2 = w12
            }
          }
        }
      }
      call "FGV Repeat Operation for all following files.gvi"(FGV Instructions="Set State", Used File Operation=w2, Error In=w6) -> (Error Out=w1)
    }
  }
  $"Existing File Instruction out" <- w2
  $"Error Out" <- w1
