vi "Random IV Curve Generator.gvi"   [LabVIEW NXG 5.0.0]
inputs:
  "Error In": error
  "JV Measurement Mega Cluster In": "JV Measurements Mega Cluster.gtype" = {"Cell Array"=[], "JV Full Data Array"=[], "JV Curve Parameters"={1, -0.2, FALSE, 0.1, TRUE, 1, 8e-06, 1000, 100, 3, 0.5, 1, 0, 0}, "Cell Selector"={FALSE, FALSE, FALSE, FALSE, FALSE, FALSE, FALSE, FALSE, FALSE, FALSE, FALSE, FALSE, FALSE, FALSE, FALSE, FALSE, FALSE, FALSE, FALSE, FALSE, FALSE, FALSE, FALSE, FALSE, FALSE, FALSE, FALSE, FALSE, FALSE, FALSE}}
  "Intensity Constant": f64
  "Light Intensity": f64
outputs:
  "Error Out": error
  "Voltage": f64[]
  "Current": f64[]
types:
  "Cell Selector.gtype" = enum{"L.01", "L.02", "L.03", "L.04", "L.05", "L.06", "L.07", "L.08", "L.09", "L.10", "L.11", "L.12", "R.01", "R.02", "R.03", "R.04", "R.05", "R.06", "R.07", "R.08", "R.09", "R.10", "R.11", "R.12", "Custom"}
  "JV Data Cluster.gtype" = cluster{"Voltage (V)": f64[], "Current (A)": f64[], "Current Density (A/m^2)": f64[], "Cell Area (m^2)": f64, "Illumination (W/m^2)": f64, "Voc (V)": f64, "Jsc (A/m^2)": f64, "FF (%)": f64, "Rsh (Ω · m^2)": f64, "Rs (Ω · m^2)": f64, "Eff (%)": f64, "Measured Cell": "Cell Selector.gtype", "No Multiplexer": bool}
  "JV Scan Mode.gtype" = enum{"Rough", "Normal", "Accurate", "Smart", "Custom"}
  "JV Curve Parameters.gtype" = cluster{"Cell Parameters": "Cell Parameters.gtype", "Measurement Precision": "Accuracy Parameters.gtype", "JV Scan Mode": "JV Scan Mode.gtype"}
  "JV Measurements Mega Cluster.gtype" = cluster{"Cell Array": "Cell Selector.gtype"[], "JV Full Data Array": "JV Data Cluster.gtype"[], "JV Curve Parameters": "JV Curve Parameters.gtype", "Cell Selector": "Cell Selector.gtype"}
uses:
  Pika IV Characterization NXG::Side Functions::Instrument Control::Keithley::Keithley Sweep Parameter Calculator.gvi
  NI::G Core::Numeric::Random Number (Range) DBL.gvi
diagram:
  case ($"Error In") {
    frame Error, Default {
      w1 = $"Error In"
      w2 = f64[] []
      w3 = f64[] []
    }
    frame No Error {
      call "Keithley Sweep Parameter Calculator.gvi"(JV Measurements Mega Cluster In=$"JV Measurement Mega Cluster In", Error In=$"Error In") -> (Sweep Points=w4, Error Out=w1)
      Property Node(instance in=w4) -> ("Start "=w5, "Stop "=w6, "Number of Points (5)"=w7)
      call "Random Number (Range) DBL.gvi"(upper bound=1.2, lower bound=0.8) -> (number=w8)
      Multiply(w8, $"Light Intensity") -> w9
      Multiply($"Intensity Constant", w8) -> w10
      To Signed 32 Bit Integer(number=w7) -> w11
      Subtract(x=w6, y=w5) -> w12
      To Double Precision Float(number=w7) -> w13
      Divide(x=w12, y=w13) -> w14
      for (N = w11) (iteration -> i1) {
        To Double Precision Float(number=i1) -> w15
        Multiply(w14, w15) -> w16
        Add(w5, w16) -> w17
        To Double Precision Float(number=w17) -> w18
        Exponential(x=w17) -> w19
        Multiply(w19, w10) -> w20
        Add(w9, w20) -> w21
        append w18 to w2
        append w21 to w3
      }
    }
  }
  $Voltage <- w2
  $Current <- w3
  $"Error Out" <- w1
