vi "Prefix Error Check.gvi"   [LabVIEW NXG 5.0.0]
inputs:
  "Error In": error
  "Misc Data Mega Cluster In": "Misc Mega Cluster.gtype"
  "Cell number required?": bool
  "Forbidden Characters?": bool
  "Current Date": string
  "Cell Number": string
outputs:
  "Error Out": error
  "Misc Data Mega Cluster Out": "Misc Mega Cluster.gtype"
types:
  "Full Reference Cluster.gtype" = cluster{"Status Report": "Status Report.gtype", "Path Cluster": "Path Cluster.gtype", "Sample Naming Cluster": "Sample Naming Cluster.gtype", "Acquisition Parameters": "Acquisition Parameters.gtype", "Live Progress Cluster": "Live Progress.gtype", "Sample Extra Information": "Sample extra imformation.gtype"}
  "Misc Mega Cluster.gtype" = cluster{"Full Reference Cluster": "Full Reference Cluster.gtype"}
diagram:
  # This SubVI checks that the prefix has all the necessary components and that it does not contain any forbidden characters, otherwise it raises an error and an error flag.
  case ($"Error In") {
    frame Error, Default {
      w1 = $"Error In"
      w2 = $"Misc Data Mega Cluster In"
    }
    frame No Error {
      Property Node(instance in=$"Misc Data Mega Cluster In") -> ("Full Reference Cluster:Sample Naming Cluster:Author Initials"=w3, "Full Reference Cluster:Sample Naming Cluster:Batch Name"=w4, instance out=w5)
      Property Node(instance in=w5) -> ("Full Reference Cluster:Sample Naming Cluster:Label Info Missing Error Ref"=w6, "Full Reference Cluster:Sample Naming Cluster:Label Info Error Label Ref"=w7, instance out=w2)
      Property Node(instance in=w4, error in=$"Error In") -> ("Value"=w8, error out=w9)
      Property Node(instance in=w3, error in=w9) -> ("Value"=w10, error out=w11)
      Is Empty String Or Path(string/path=$"Cell Number") -> w12
      Logical And($"Cell number required?", w12) -> w13
      Is Empty String Or Path(string/path=w10) -> w14
      Is Empty String Or Path(string/path=$"Current Date") -> w15
      Is Empty String Or Path(string/path=w8) -> w16
      Logical Or(w14, w15, w16, $"Forbidden Characters?", w13) -> w17
      Property Node(instance in=w6, "Value"=w17, error in=w11) -> (error out=w18)
      w19 = """You used one of these characters,
which cannot be used for naming files and folders:
 \ / * : ? " < > |
If you do not fix it, your files will NOT be saved.
"""
      Select(s=$"Forbidden Characters?", t=w19, f="") -> w20
      Select(s=w13, t="I'm missing the Cell Name.\n", f="") -> w21
      Select(s=w14, t="I'm missing the author's initials.\n", f="") -> w22
      Select(s=w15, t="I'm missing the Current Date.\n", f="") -> w23
      Select(s=w16, t="I'm missing the Batch Name.\n", f="") -> w24
      Concatenate Strings(w22, w23, w24, w20, w21) -> w25
      Property Node(instance in=w7, "Value"=w25, error in=w18) -> (error out=w1)
    }
  }
  $"Misc Data Mega Cluster Out" <- w2
  $"Error Out" <- w1
