vi "Prefix Generator.gvi"   [LabVIEW NXG 5.0.0]
inputs:
  "Error In": error
  "Misc Data Mega Cluster In": "Misc Mega Cluster.gtype"
  "Cell number required?": bool
  "Current Date": string
  "Cell Number": string
outputs:
  "Error Out": error
  "Misc Data Mega Cluster Out": "Misc Mega Cluster.gtype"
types:
  "Full Reference Cluster.gtype" = cluster{"Status Report": "Status Report.gtype", "Path Cluster": "Path Cluster.gtype", "Sample Naming Cluster": "Sample Naming Cluster.gtype", "Acquisition Parameters": "Acquisition Parameters.gtype", "Live Progress Cluster": "Live Progress.gtype", "Sample Extra Information": "Sample extra imformation.gtype"}
  "Misc Mega Cluster.gtype" = cluster{"Full Reference Cluster": "Full Reference Cluster.gtype"}
uses:
  Pika IV Characterization NXG::Side Functions::Utilities::Cell Naming::Prefix Error Check.gvi
diagram:
  # This SubVI takes all the needed Parameters and creates the cell prefix.
  # It also creates an error label in case there is something wrong with the
  # name such as missing labels or forbidden characters
  case ($"Error In") {
    frame Error, Default {
      w1 = $"Error In"
      w2 = $"Misc Data Mega Cluster In"
    }
    frame No Error {
      Property Node(instance in=$"Misc Data Mega Cluster In") -> ("Full Reference Cluster:Sample Naming Cluster:Author Initials"=w3, "Full Reference Cluster:Sample Naming Cluster:Batch Name"=w4, "Full Reference Cluster:Sample Naming Cluster:Sample Comments"=w5, instance out=w6)
      Property Node(instance in=w3) -> ("Value"=w7)
      Property Node(instance in=w4) -> ("Value"=w8)
      Property Node(instance in=w5) -> ("Value"=w9)
      Build Array(w7, $"Current Date", w8, w9, $"Cell Number") -> w10
      s1 = ""  # shift register
      for {
        w11 = each element of w10
        Is Empty String Or Path(string/path=w11) -> w12
        case (w12) {
          frame False, Default {
            Concatenate Strings(s1, w11, ".") -> w13
          }
          frame True {
            w13 = s1
          }
        }
        next s1 = w13
      }
      s2 = $"Error In"  # shift register
      for {
        w14 = each element of ["/", "\\", "*", ":", "?", "\"", ">", "<", "|"]
        Search And Replace String(error in (no error)=s2, input string=s1, replace all (F)=TRUE, search string=w14) -> (error out=w16, number of replacements=w17, result string=w18)
        Is Greater Than 0(x=w17) -> w19
        append w19 to w15
        next s2 = w16
      }
      Or Array Elements(Boolean array=w15) -> (logical OR=w20)
      call "Prefix Error Check.gvi"(Misc Data Mega Cluster In=w6, Current Date=$"Current Date", Cell Number=$"Cell Number", Error In=s2, Cell number required?=$"Cell number required?", Forbidden Characters?=w20) -> (Misc Data Mega Cluster Out=w21)
      Property Node(instance in=w21) -> ("Full Reference Cluster:Sample Naming Cluster:Sample Prefix"=w22, instance out=w2)
      Property Node(instance in=w22, "Value"=w18) -> (error out=w1)
    }
  }
  $"Error Out" <- w1
  $"Misc Data Mega Cluster Out" <- w2
