vi "Sample Naming Subroutine.gvi"   [LabVIEW NXG 5.0.0]
inputs:
  "Error In": error
  "Misc Data Mega Cluster In": "Misc Mega Cluster.gtype"
outputs:
  "Error Out": error
  "Misc Data Mega Cluster Out": "Misc Mega Cluster.gtype"
types:
  T1 = cluster{"State Ref": "StringControl reference", "Substate Ref": "StringControl reference", "Current State Ref": "EnumSelector reference", "Main Tab Ref": "TabControl reference"}
  T2 = cluster{"Default Data Saving Location Ref": "PathSelector reference"}
  T3 = cluster{"Author Initials Ref": "ComboBoxSelector reference", "Batch Name Ref": "StringControl reference", "Cell Number Ref": "StringControl reference", "Current Date Ref": "StringControl reference", "Sample Comments Ref": "StringControl reference", "Sample Prefix Ref": "StringControl reference", "Custom Date Ref": "CheckBox reference", "Label Info Error Label Ref": "StringControl reference", "Label Info Missing Error Ref": "BooleanControl reference"}
  T4 = cluster{"Cell Parameters Ref": "Cluster reference", "Cell Selector Ref": "Cluster reference", "Measurement Precision Ref": "Cluster reference", "JV Scan Mode Ref": "EnumSelector reference"}
  T5 = cluster{"Live JV Parameters Ref": "Cluster reference", "Progress % Ref": "ProgressBar reference", "Progress Counter Ref": "NumericTextBoxDouble reference"}
  T6 = cluster{"Layer Information Ref": "ArrayViewer reference"[]}
  T7 = cluster{"Cell Selector Block Ref": "Rectangle reference", "Smart Mode Block Ref": "Rectangle reference", "dV Block Ref": "Rectangle reference", "Smart Mode Text Ref": "Text reference"}
  "Full Reference Cluster.gtype" = cluster{"Status Report": T1, "Path Cluster": T2, "Sample Naming Cluster": T3, "Acquisition Parameters": T4, "Live Progress Cluster": T5, "Sample Extra Information": T6, "Visual Elements": T7}
  "Misc Mega Cluster.gtype" = cluster{"Full Reference Cluster": "Full Reference Cluster.gtype"}
uses:
  Pika IV Characterization NXG::Side Functions::Utilities::Time::Get Date YYMMDD.gvi
  Pika IV Characterization NXG::Side Functions::Utilities::Cell Naming::Prefix Generator.gvi
diagram:
  # This SubVI Takes the data from the Sample Naming Variables and it generates the prefix so that the files can be propperly saved
  case ($"Error In") {
    frame Error, Default {
      w1 = $"Error In"
      w2 = $"Misc Data Mega Cluster In"
    }
    frame No Error {
      Property Node(instance in=$"Misc Data Mega Cluster In") -> ("Full Reference Cluster:Sample Naming Cluster:Custom Date Ref"=w3, "Full Reference Cluster:Sample Naming Cluster:Current Date Ref"=w4, instance out=w5)
      Property Node(instance in=w4, error in=$"Error In") -> ("Value"=w6, error out=w7, instance out=w8)
      Property Node(instance in=w3, error in=w7) -> ("Value"=w9, error out=w10)
      case (w9) {
        frame True {
          Property Node(instance in=w8, "Disabled"=FALSE, error in=w10) -> (error out=w12, instance out=w13)
          w11 = w6
        }
        frame False {
          Property Node(instance in=w8, "Disabled"=TRUE, error in=w10) -> (error out=w14, instance out=w13)
          call "Get Date YYMMDD.gvi"(Error In=w14) -> (Date YYMMDD=w11, Error Out=w12)
        }
      }
      Property Node(instance in=w5) -> ("Full Reference Cluster:Acquisition Parameters:Cell Selector Ref"=w15, "Full Reference Cluster:Sample Naming Cluster:Cell Number Ref"=w16, instance out=w17)
      Property Node(instance in=w13, "Value"=w11, error in=w12) -> (error out=w18)
      Property Node(instance in=w15, error in=w18) -> ("Value"=w19, error out=w20)
      Property Node(instance in=w19) -> ("No Multiplexer"=w21)
      Property Node(instance in=w16, error in=w20) -> ("Value"=w22, error out=w23)
      case (w21) {
        frame False, Default {
          w24 = ""
          w25 = FALSE
          w26 = w23
        }
        frame True {
          w24 = w22
          w25 = TRUE
          w26 = w23
        }
      }
      call "Prefix Generator.gvi"(Misc Data Mega Cluster In=w17, Current Date=w11, Cell Number=w24, Error In=w26, Cell number required?=w25) -> (Misc Data Mega Cluster Out=w2, Error Out=w1)
    }
  }
  $"Misc Data Mega Cluster Out" <- w2
  $"Error Out" <- w1
