vi "test.gvi"   [LabVIEW NXG 5.0.0]
panel controls:
  "Measured Cell": T1 = "L.01"
panel indicators:
  "remainder": u16
  "quotient": u16
types:
  T1 = enum{"L.01", "L.02", "L.03", "L.04", "L.05", "L.06", "L.07", "L.08", "L.09", "L.10", "L.11", "L.12", "R.01", "R.02", "R.03", "R.04", "R.05", "R.06", "R.07", "R.08", "R.09", "R.10", "R.11", "R.12", "Custom"}
diagram:
  while {
    Quotient And Remainder(x=$"Measured Cell", y=12) -> (floor(x/y)=w1, x-y*floor(x/y)=w2)
    Increment(x=w2) -> w3
    $remainder <- w3
    $quotient <- w1
    Wait Until Next Multiple(multiple to wait=50)
    stop if FALSE
  }
